# Grasshopper definition team_03_working.gh (Grasshopper 1.0.8)
# plug-ins: Human, Swiftlet

# ----
# Connect MCP Tools to Decall and Update All Clusters
button = Button()
# IF SOMETHING IS NOT
# WORKING PRESS THIS
# BUTTON FIRST
toggle = BooleanToggle(True)
connect_mcp_tools_to_decall = CSharpScript(nickname_From="Central MCP Server", nickname_To="Central DeCall", connect=button)  # -> out; inputs nickname_From: String, nickname_To: String, connect: Boolean
# ---------- connect_mcp_tools_to_decall: C# ----------
using System;
using System.Linq;
using Grasshopper;
using Grasshopper.Kernel;

public class Script_Instance : GH_ScriptInstance
{
    private void RunScript(string nickname_From, string nickname_To, bool connect)
    {
        if (!connect) return;
        Console.Write($"Attempting to connect outputs from '{nickname_From}' to '{nickname_To}'...");

        var ghDoc = Instances.ActiveCanvas?.Document;
        if (ghDoc == null) return;

        var compFrom = ghDoc.Objects
            .OfType<IGH_Component>()
            .FirstOrDefault(o => o.NickName == nickname_From);

        var compTo = ghDoc.Objects
            .OfType<IGH_Param>()
            .FirstOrDefault(o => o.NickName == nickname_To);

        if (compFrom != null && compTo != null)
        {
            ghDoc.ScheduleSolution(5, doc => Connect(doc, compFrom, compTo));
        }
    }

    // <Custom additional code> 
    private void Connect(GH_Document doc, IGH_Component compFrom, IGH_Param compTo)
    {
        if (compFrom == null || compTo == null) return;

        foreach (IGH_Param param in compFrom.Params.Output)
        {
            compTo.AddSource(param);
        }
    }
}
# ---------- end connect_mcp_tools_to_decall ----------
update_all_clusters = CSharpScript(update=button, recursive=toggle)  # -> out, A; inputs update: Boolean, recursive: Boolean, passwords: list of String, localPath: String
# ---------- update_all_clusters: C# ----------
using System;
using System.Collections;
using System.Collections.Generic;

using Rhino;
using Rhino.Geometry;

using Grasshopper;
using Grasshopper.Kernel;
using Grasshopper.Kernel.Data;
using Grasshopper.Kernel.Types;
using System.Windows.Forms;
using System.Linq;
/// <summary>
/// This class will be instantiated on demand by the Script component.
/// </summary>
public class Script_Instance : GH_ScriptInstance
{
  /// <summary>Print a String to the [Out] Parameter of the Script component.</summary>
  /// <param name="text">String to print.</param>
  private void Print(string text) { /* Implementation hidden. */ }
  /// <summary>Print a formatted String to the [Out] Parameter of the Script component.</summary>
  /// <param name="format">String format.</param>
  /// <param name="args">Formatting parameters.</param>
  private void Print(string format, params object[] args) { /* Implementation hidden. */ }
  /// <summary>Print useful information about an object instance to the [Out] Parameter of the Script component. </summary>
  /// <param name="obj">Object instance to parse.</param>
  private void Reflect(object obj) { /* Implementation hidden. */ }
  /// <summary>Print the signatures of all the overloads of a specific method to the [Out] Parameter of the Script component. </summary>
  /// <param name="obj">Object instance to parse.</param>
  private void Reflect(object obj, string method_name) { /* Implementation hidden. */ }

  /// <summary>Gets the current Rhino document.</summary>
  private readonly RhinoDoc RhinoDocument;
  /// <summary>Gets the Grasshopper document that owns this script.</summary>
  private readonly GH_Document GrasshopperDocument;
  /// <summary>Gets the Grasshopper script component that owns this script.</summary>
  private readonly IGH_Component Component;
  /// <summary>
  /// Gets the current iteration count. The first call to RunScript() is associated with Iteration==0.
  /// Any subsequent call within the same solution will increment the Iteration count.
  /// </summary>
  private readonly int Iteration;

  /// <summary>
  /// This procedure contains the user code. Input parameters are provided as regular arguments,
  /// Output parameters as ref arguments. You don't have to assign output parameters,
  /// they will have a default value.
  /// </summary>
  private void RunScript(
		bool update,
		bool recursive,
		List<string> passwords,
		string localPath,
		ref object A)
  {

    A = updateLog;
    if (update)
    {
      updateLog = new List<string>();
      _passwords = passwords;
      UpdateClusters(GrasshopperDocument, recursive, localPath);
    }

  }

  // <Custom additional code> 
  List<string> updateLog;
  List<String> _passwords;

  void UpdateClusters (GH_Document ghDoc, bool recursive, string localPath)
  {
    foreach (var obj in ghDoc.Objects)
    {
      var cluster = obj as Grasshopper.Kernel.Special.GH_Cluster;
      if (cluster != null)
      {
        var clusterPath = cluster.FilePath;
        if (!string.IsNullOrEmpty(clusterPath))
        {
          if (cluster.Synchronisation == Grasshopper.Kernel.Special.GH_Synchronisation.OutOfDate)
          {
            cluster.CreateFromFilePath(clusterPath);
            updateLog.Add("Updated: " + clusterPath);
          }
          else if (cluster.Synchronisation == Grasshopper.Kernel.Special.GH_Synchronisation.MissingReference)
          {
            string newPath = ReplacePath(localPath, clusterPath);
            if (!string.IsNullOrEmpty(newPath))
            {
              cluster.CreateFromFilePath(newPath);
              updateLog.Add("Replaced and updated: " + newPath);
            }
            else
            {
              updateLog.Add("Missing reference: " + clusterPath);
            }

          }
        }

        //Update recursively
        if (recursive)
        {
          GH_Document clusterDoc = GetClusterDoc(cluster);
          if (clusterDoc != null)
            UpdateClusters(clusterDoc, recursive, localPath);
        }
      }
    }
  }

  GH_Document GetClusterDoc(Grasshopper.Kernel.Special.GH_Cluster cluster)
  {
    //no pass needed
    var doc = cluster.Document(string.Empty);
    if (doc != null)
      return doc;

    //try passwords
    if (_passwords != null && _passwords.Any())
    {
      foreach (var pass in _passwords)
      {
        doc = cluster.Document(pass);
        if (doc != null)
          return doc;
      }
    }

    return null;
  }

  string ReplacePath(string localPath, string missingPath)
  {
    if (String.IsNullOrEmpty(missingPath) || string.IsNullOrEmpty(localPath))
      return null;
    else
    {
      string lastLocalPart = localPath.Split('\\').Last();
      string[] parts = missingPath.Split('\\');
      if (parts.Contains(lastLocalPart))
      {
        int i = Array.IndexOf(parts, lastLocalPart);
        string clusterPath = String.Join("\\", parts.Skip(i + 1));
        string result = String.Join("\\", localPath, clusterPath);
        return result;
      }
      else
        return null;
    }
  }
  // </Custom additional code> 
}
# ---------- end update_all_clusters ----------
panel = Panel(connect_mcp_tools_to_decall)

team_03_definition_cluster = Team03DefinitionCluster()
c_script = CSharpScript()  # -> out, availablePort
# ---------- c_script: C# ----------
// Grasshopper Script Instance
// This script finds an available port on the local machine.
#region Usings
using System;
using System.Linq;
using System.Collections;
using System.Collections.Generic;
using System.Drawing;
using System.Net;
using System.Net.Sockets;

using Rhino;
using Rhino.Geometry;

using Grasshopper;
using Grasshopper.Kernel;
using Grasshopper.Kernel.Data;
using Grasshopper.Kernel.Types;
#endregion

public class Script_Instance : GH_ScriptInstance
{
    #region Notes
    /* 
      Members:
        RhinoDoc RhinoDocument
        GH_Document GrasshopperDocument
        IGH_Component Component
        int Iteration

      Methods (Virtual & overridable):
        Print(string text)
        Print(string format, params object[] args)
        Reflect(object obj)
        Reflect(object obj, string method_name)
    */
    #endregion

    private void RunScript(object start, object end, ref object availablePort)
    {
        // Use default values if parameters are not provided
        int startPort = (start != null && int.TryParse(start.ToString(), out int s)) ? s : 3001;
        int endPort = (end != null && int.TryParse(end.ToString(), out int e)) ? e : 3100;

        // Find an available port in the specified range
        try
        {
            availablePort = FindAvailablePortInRange(startPort, endPort);
            Print($"Available port found: {availablePort}");
        }
        catch (Exception ex)
        {
            Print($"Error: {ex.Message}");
            availablePort = null;
        }
    }

    /// <summary>
    /// Checks if a local TCP port is available for binding (i.e., not in use).
    /// Returns True if available, False otherwise.
    /// </summary>
    private bool IsPortAvailableForBind(int port)
    {
        try
        {
            // Create a new TCP socket
            using (Socket socket = new Socket(AddressFamily.InterNetwork, SocketType.Stream, ProtocolType.Tcp))
            {
                // Try to bind to the port on all interfaces (0.0.0.0)
                socket.Bind(new IPEndPoint(IPAddress.Any, port));
                // If successful, the socket is closed by the using statement and return True
                return true;
            }
        }
        catch (SocketException)
        {
            // If binding fails, it means the port is already in use
            return false;
        }
    }

    /// <summary>
    /// Finds an available port by letting the OS assign one.
    /// </summary>
    private int FindAvailablePort()
    {
        Socket socket = new Socket(AddressFamily.InterNetwork, SocketType.Stream, ProtocolType.Tcp);
        socket.Bind(new IPEndPoint(IPAddress.Any, 0)); // Bind to an available port assigned by the OS
        int availablePort = ((IPEndPoint)socket.LocalEndPoint).Port; // Get the assigned port number
        socket.Close(); // Close the socket
        return availablePort;
    }

    /// <summary>
    /// Finds the first available port in a given range.
    /// </summary>
    private int FindAvailablePortInRange(int start = 3001, int end = 3100)
    {
        for (int port = start; port <= end; port++)
        {
            if (IsPortAvailableForBind(port))
                return port;
        }
        throw new Exception($"No available ports found in the range {start}-{end}.");
    }
}
# ---------- end c_script ----------
central_mcp_server = MCPServer(Port=c_script.availablePort, Tools=team_03_definition_cluster, ServerName="Swiftlet")  # -> Get_visibility, Collision_detector_sphere, Simulate_circulation
panel_2 = Panel(c_script.availablePort)
get_tool_names = CSharpScript(x=team_03_definition_cluster)  # -> flatten(out)
# ---------- get_tool_names: C# ----------
// Grasshopper Script Instance
#region Usings
using System;
using System.Linq;
using System.Collections;
using System.Collections.Generic;
using System.Drawing;

using Rhino;
using Rhino.Geometry;

using Grasshopper;
using Grasshopper.Kernel;
using Grasshopper.Kernel.Data;
using Grasshopper.Kernel.Types;
#endregion

public class Script_Instance : GH_ScriptInstance
{
    #region Notes
    /* 
      Members:
        RhinoDoc RhinoDocument
        GH_Document GrasshopperDocument
        IGH_Component Component
        int Iteration

      Methods (Virtual & overridable):
        Print(string text)
        Print(string format, params object[] args)
        Reflect(object obj)
        Reflect(object obj, string method_name)
    */
    #endregion

    private void RunScript(object x)
    {
        dynamic dynamicX = x;
        Console.Write(dynamicX.Name);
    }
}
# ---------- end get_tool_names ----------
central_decall = Data(central_mcp_server.Get_visibility)

# ---- group: Input Layout
json_file_path = FilePath("C:\Users\gramo\Downloads\layout.json")
json2string = Python3Script(path=json_file_path)  # -> out, json_string; same code as json2string

# ----
clean = CleanTree(RemoveNulls=True, RemoveInvalid=True, RemoveEmpty=False, Tree=central_decall)
panel_3 = Panel(json_file_path)

# ---- group: Output Layout
json_file_path_2 = FilePath("C:\Users\jomig\repos\AIA26_Studio\team_01\team_01_edited_layout.json")
json2string_2 = Python3Script(path=json_file_path_2)  # -> out, json_string; same code as json2string

# ----
team_03_result_cluster = Team03ResultCluster(tool_call_request=clean)  # -> tool_names_4, tool_call_success

# ----
# Tool Names from the Results Clusters
# Tool Names from the Definition Clusters
# These Two Clusters should be EXACTLY THE SAME
panel_4 = Panel(get_tool_names)
panel_5 = Panel(team_03_result_cluster.tool_names_4)

panel_6 = Panel(json_file_path_2)

# ---- group: 0 = Before, 1= After
# Visualize Layout from JSON: Before and After
number_slider = Slider(0, range=0..1)

# ----
rec = DataRecorder(team_03_result_cluster.tool_call_success, DataLimit=-10, RecordData=True)
rec_2 = DataRecorder(clean, DataLimit=-10, RecordData=True)

# ---- group: Request Parameters
decall = DeconstructToolCall(Request=clean)  # -> Request, Tool, Arguments
rjo = ReadJSONObject(JObject=decall.Arguments)  # -> Keys, JTokens
# Debug: Check request input data
panel_7 = Panel("room_name")
tmatch = MatchText(Text=rjo.Keys, Pattern=panel_7, Case=True)
tmatch_2 = MatchText(Text=rjo.Keys, Pattern="layout_json", Case=True)
dispatch = Dispatch(List=rjo.JTokens, DispatchPattern=tmatch)  # -> ListA, ListB
dispatch_2 = Dispatch(List=rjo.JTokens, DispatchPattern=tmatch_2)  # -> ListA, ListB
panel_8 = Panel(dispatch.ListA)
panel_9 = Panel(dispatch_2.ListA)

# ----
response_ok = Panel(rec)
called_tool_name = Panel(rec_2)
filter = StreamFilter(Gate=number_slider, Stream0=json2string.json_string, Stream1=json2string_2.json_string)

# ---- group: Extractor Tool do map json to grasshopper data
extractor = Python3Script(json_str=filter)  # -> out, outline_curve, room_names, room_curves, door_names, door_curves, window_names, window_curves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; same code as extractor

# ---- group: Windows
data = Data(extractor.window_curves)
previewlw = CustomPreviewLineweights(Geometry=data, Shader=ColourSwatch(SwatchColor=RGB(56, 56, 56)), Thickness=Slider(5.4, range=0..10), Absolute=False)

# ---- group: Polylines
srf = Surface(extractor.room_curves)
preview = CustomPreview(Geometry=srf, Material=[ColourSwatch(SwatchColor=RGB(167, 219, 44)), ColourSwatch(SwatchColor=RGB(4, 154, 184))])

# ---- group: Labels
area = Area(Geometry=srf)  # -> Area, Centroid
tag = TextTag(Location=area.Centroid, Text=extractor.room_names)

# ----
# Debug Tool Names
# This Panel should always be TRUE
tool_names_from_the_results_clusters = Data(panel_5)
tool_names_from_the_definition_clusters = Data(panel_4)
join = TextJoin(Text=flatten(tool_names_from_the_definition_clusters))
join_2 = TextJoin(Text=flatten(tool_names_from_the_results_clusters))
tstat = TreeStatistics(Tree=tool_names_from_the_definition_clusters)  # -> Paths, Length, Count
tstat_2 = TreeStatistics(Tree=tool_names_from_the_results_clusters)  # -> Paths, Length, Count
dpath = DeconstructPath(Branch=tstat.Paths)
dpath_2 = DeconstructPath(Branch=tstat_2.Paths)
equals = Equality(FirstNumber=tstat.Length, SecondNumber=tstat_2.Length)  # -> Equality, Inequality
equals_2 = Equality(FirstNumber=tstat.Count, SecondNumber=tstat_2.Count)  # -> Equality, Inequality
ma = MassAddition(Input=flatten(equals.Equality))  # -> Result, PartialResults
equals_3 = Equality(FirstNumber=dpath, SecondNumber=dpath_2)  # -> Equality, Inequality
lng = ListLength(List=equals.Equality)
ma_2 = MassAddition(Input=flatten(equals_3.Inequality))  # -> Result, PartialResults
equals_4 = Equality(FirstNumber=ma.Result, SecondNumber=lng)  # -> Equality, Inequality
does_quantity_of_tools_match = Panel(equals_2.Equality)
equals_5 = Equality(FirstNumber=ma_2.Result, SecondNumber="0")  # -> Equality, Inequality
does_quantity_of_tools_match_per_team = Panel(equals_4.Equality)
are_all_teams_included = Panel(equals_5.Equality)

tmatch_3 = MatchText(Text=join, Pattern=join_2, Case=True)

do_all_names_match = Panel(tmatch_3)
and = GateAnd(A=equals_5.Equality, B=equals_4.Equality, C=equals_2.Equality, D=tmatch_3)  # -> flatten(Result)
do_trees_match = Panel(and)

# ==== cluster Team03DefinitionCluster

panel = Panel("The Length of Any Side of the Base of a Square Pyramid")  # disabled
# Team 03 Definition Cluster
# SQUARE PYRAMID TEAM
panel_2 = Panel("The Length of Any Side of the Base of a Square Pyramid")  # disabled
panel_3 = Panel("The Height of a Square Pyramid")  # disabled
panel_4 = Panel("The Height of a Square Pyramid")  # disabled
panel_5 = Panel("This tool computes the area of a square pyramid by giving it the length of any side of the square base and the height of the point.  The output unit is the input unit squared.")  # disabled
panel_6 = Panel("This tool computes the volume of a square pyramid by giving it the length of any side of the square base and the height of the point.  The output unit is the input unit cubed.")  # disabled
panel_7 = Panel("This tool deletes a room by giving it a room name and the layout json")  # disabled
toggle = BooleanToggle(True)  # disabled
panel_8 = Panel("This tool deletes a room by giving it a room name and the layout json")  # disabled
toggle_2 = BooleanToggle(True)  # disabled
toggle_3 = BooleanToggle(True)  # disabled
toggle_4 = BooleanToggle(True)  # disabled
panel_9 = Panel("length")  # disabled
panel_10 = Panel("number")  # disabled
panel_11 = Panel("height")  # disabled
panel_12 = Panel("number")  # disabled
panel_13 = Panel("length")  # disabled
panel_14 = Panel("height")  # disabled
panel_15 = Panel("number")  # disabled
panel_16 = Panel("number")  # disabled
panel_17 = Panel("the name of the room")  # disabled
panel_18 = Panel("the layout data structure")  # disabled
panel_19 = Panel("the name of the room")  # disabled
panel_20 = Panel("the layout data structure")  # disabled
panel_21 = Panel("The width of the window")  # disabled
panel_22 = Panel("room_name")  # disabled
toggle_5 = BooleanToggle(True)  # disabled
panel_23 = Panel("layout_json")  # disabled
panel_24 = Panel("room_name")  # disabled
toggle_6 = BooleanToggle(True)  # disabled
toggle_7 = BooleanToggle(True)  # disabled
panel_25 = Panel("layout_json")  # disabled
toggle_8 = BooleanToggle(True)  # disabled
panel_26 = Panel("width")  # disabled
toggle_9 = BooleanToggle(True)  # disabled
panel_27 = Panel("compute_area_of_square_pyramid")  # disabled
panel_28 = Panel("compute_volume_of_square_pyramid")  # disabled
panel_29 = Panel("string")  # disabled
panel_30 = Panel("string")  # disabled
panel_31 = Panel("string")  # disabled
panel_32 = Panel("string")  # disabled
panel_33 = Panel("number")  # disabled
param = DefineToolParameter(Name=panel_11, Type=panel_12, Description=panel_3, Required=toggle)  # disabled
param_2 = DefineToolParameter(Name=panel_9, Type=panel_10, Description=panel, Required=toggle_2)  # disabled
param_3 = DefineToolParameter(Name=panel_14, Type=panel_16, Description=panel_4, Required=toggle_3)  # disabled
param_4 = DefineToolParameter(Name=panel_13, Type=panel_15, Description=panel_2, Required=toggle_4)  # disabled
panel_34 = Panel("delete_room_03")  # disabled
panel_35 = Panel("add_window_03")  # disabled
param_5 = DefineToolParameter(Name=panel_22, Type=panel_29, Description=panel_17, Required=toggle_5)  # disabled
merge = Merge(Data1=param_2, Data2=param)  # disabled
merge_2 = Merge(Data1=param_4, Data2=param_3)  # disabled
param_6 = DefineToolParameter(Name=panel_23, Type=panel_30, Description=panel_18, Required=toggle_6)  # disabled
param_7 = DefineToolParameter(Name=panel_24, Type=panel_31, Description=panel_19, Required=toggle_7)  # disabled
param_8 = DefineToolParameter(Name=panel_25, Type=panel_32, Description=panel_20, Required=toggle_8)  # disabled
param_9 = DefineToolParameter(Name=panel_26, Type=panel_33, Description=panel_21, Required=toggle_9)  # disabled
merge_3 = Merge(Data1=param_5, Data2=param_6)  # disabled
merge_4 = Merge(Data1=param_7, Data2=param_9, Data3=param_8)  # disabled
tool = DefineTool(Name=panel_27, Description=panel_5, Parameters=merge)  # disabled
tool_2 = DefineTool(Name=panel_28, Description=panel_6, Parameters=merge_2)  # disabled
tool_3 = DefineTool(Name=panel_34, Description=panel_7, Parameters=merge_3)  # disabled
tool_4 = DefineTool(Name=panel_35, Description=panel_8, Parameters=merge_4)  # disabled

# ----
# Ramy
panel_36 = Panel("Use this tool to analyze what rooms are visible from a given room in the apartment floor plan. Input the room name (corridor, kitchen, living, dining, bedroom1, bedroom2, wc1, wc2, wc3) to get visibility percentages.")
param_10 = DefineToolParameter(Name="room_name", Type="string", Description="the name of the room to analyze visibility from", Required=Toggle(True))
param_11 = DefineToolParameter(Name="radius", Type="number", Description="the viewing radius in meters", Required=Toggle(True))
merge_5 = Merge(Data1=param_10, Data2=param_11)
tool_5 = DefineTool(Name="get_visibility", Description=panel_36, Parameters=merge_5)

# ----
# Ramon
panel_37 = Panel("location of a point in a normalized polyline lenght, values form 0.00 to 1.00")
panel_38 = Panel("This tool detects collisions by a moving sphere traveling along a polyline, automatically adjusting its radius based on the current segment while performing real-time collision detection against obstacles. When collisions occur, the sphere turns red and displays a warning message. The system dynamically adapts to polyline changes, recalculating all parameters whenever segments are added or modified.")
param_12 = DefineToolParameter(Name="sphere_radius_list", Type="number", Description="radius of the sphere", Required=Toggle(True))
param_13 = DefineToolParameter(Name="point_in_path", Type="number", Description=panel_37, Required=Toggle(True))
merge_6 = Merge(Data1=param_12, Data2=param_13)
tool_6 = DefineTool(Name="collision_detector_sphere", Description=panel_38, Parameters=merge_6)

# ----
# Hani
panel_39 = Panel("This tool simulates agent movement through a residential layout and scores rooms for circulation quality, bottlenecks, and flow efficiency")
panel_40 = Panel("the entry point of the layout, typically the entrance or foyer")
param_14 = DefineToolParameter(Name="start_room", Type="string", Description=panel_40, Required=Toggle(True))
param_15 = DefineToolParameter(Name="layout_json", Type="string", Description="the layout data structure", Required=Toggle(True))
merge_7 = Merge(Data1=param_14, Data2=param_15)
tool_7 = DefineTool(Name="simulate_circulation", Description=panel_39, Parameters=merge_7)

merge_8 = Merge(Data1=tool_2, Data2=tool, Data3=tool_3, Data4=tool_4, Data5=tool_5, Data6=tool_6, Data7=tool_7)
mcp_tool_list = ClusterOutput(merge_8)

# ==== cluster Team03ResultCluster

# ----
# Team 03 Result Cluster
# SQUARE PYRAMID TEAM
# Edit Tool Names to
# Match Definition Cluster
tool_names = Panel("""compute_volume_of_square_pyramid
compute_area_of_square_pyramid
delete_room_03
add_window_03
get_visibility""")

tool_names_2 = Panel("""get_visibility
collision_detector_sphere
simulate_circulation""")

# ----
# Sorting Logic, Please Do Not Edit
tool_call_request = ClusterInput()
tool_names_3 = Text(tool_names_2)
decall = DeconstructToolCall(Request=tool_call_request)  # -> Request, Tool, Arguments
mindex = MemberIndex(Set=tool_names_2, Member=decall.Tool)  # -> Index, Count
sift = SiftPattern(List=decall.Request, SiftPattern=mindex.Index)  # -> Output0, Output1, Output2

# ---- group: Cluster Output
tool_names_4 = ClusterOutput(tool_names_3)

# ---- group: Get the request sent from VSC Agent
decall_2 = DeconstructToolCall()  # -> Request, Tool, Arguments; disabled

# ----
decall_3 = DeconstructToolCall()  # -> Request, Tool, Arguments; disabled
panel = Panel("length")  # disabled
panel_2 = Panel("height")  # disabled
gjok = GetJSONObjectKey(JObject=decall_3.Arguments, Key=panel_2)  # disabled
gjok_2 = GetJSONObjectKey(JObject=decall_3.Arguments, Key=panel)  # disabled
rjv = ReadJSONValue(JValue=gjok_2)  # -> AsString, AsNumber, AsBool; disabled
rjv_2 = ReadJSONValue(JValue=gjok)  # -> AsString, AsNumber, AsBool; disabled
rectangle = Rectangle(Plane=PlaneXY(0, 0, 0), XSize=rjv.AsNumber, YSize=rjv.AsNumber, Radius=0)  # -> Rectangle, Length; disabled
pcen = PolygonCenter(Polyline=rectangle.Rectangle)  # -> CenterV, CenterE, CenterA; disabled
Z = UnitZ(Factor=rjv_2.AsNumber)  # disabled
avr = Average(Input=pcen.CenterV)  # disabled
move = Move(Geometry=avr, Motion=Z)  # -> Geometry, Transform; disabled
extr = ExtrudePoint(Base=rectangle.Rectangle, Point=move.Geometry)  # disabled
cap = CapHoles(Brep=extr)  # disabled
volume = Volume(Geometry=cap)  # -> Volume, Centroid; disabled

decall_4 = DeconstructToolCall()  # -> Request, Tool, Arguments; disabled
panel_3 = Panel("height")  # disabled
panel_4 = Panel("length")  # disabled
gjok_3 = GetJSONObjectKey(JObject=decall_4.Arguments, Key=panel_3)  # disabled
gjok_4 = GetJSONObjectKey(JObject=decall_4.Arguments, Key=panel_4)  # disabled
rjv_3 = ReadJSONValue(JValue=gjok_3)  # -> AsString, AsNumber, AsBool; disabled
rjv_4 = ReadJSONValue(JValue=gjok_4)  # -> AsString, AsNumber, AsBool; disabled
rectangle_2 = Rectangle(Plane=PlaneXY(0, 0, 0), XSize=rjv_4.AsNumber, YSize=rjv_4.AsNumber, Radius=0)  # -> Rectangle, Length; disabled
pcen_2 = PolygonCenter(Polyline=rectangle_2.Rectangle)  # -> CenterV, CenterE, CenterA; disabled
Z_2 = UnitZ(Factor=rjv_3.AsNumber)  # disabled
avr_2 = Average(Input=pcen_2.CenterV)  # disabled
move_2 = Move(Geometry=avr_2, Motion=Z_2)  # -> Geometry, Transform; disabled
extr_2 = ExtrudePoint(Base=rectangle_2.Rectangle, Point=move_2.Geometry)  # disabled
cap_2 = CapHoles(Brep=extr_2)  # disabled
area = Area(Geometry=cap_2)  # -> Area, Centroid; disabled

decall_5 = DeconstructToolCall(Request=sift.Output1)  # -> Request, Tool, Arguments
gjok_5 = GetJSONObjectKey(JObject=decall_5.Arguments, Key="point_in_path")
gjok_6 = GetJSONObjectKey(JObject=decall_5.Arguments, Key="sphere_radius_list")
rjv_5 = ReadJSONValue(JValue=gjok_5)  # -> AsString, AsNumber, AsBool
rjv_6 = ReadJSONValue(JValue=gjok_6)  # -> AsString, AsNumber, AsBool

decall_6 = DeconstructToolCall(Request=sift.Output0)  # -> Request, Tool, Arguments
gjok_7 = GetJSONObjectKey(JObject=decall_6.Arguments, Key="room_name")
gjok_8 = GetJSONObjectKey(JObject=decall_6.Arguments, Key="radius")
rjv_7 = ReadJSONValue(JValue=gjok_8)  # -> AsString, AsNumber, AsBool
rjv_8 = ReadJSONValue(JValue=gjok_7)  # -> AsString, AsNumber, AsBool

panel_5 = Panel("E:\IAAC Local GIT Repositories\AIA26_Studio\team_03\python\layout.json")

# ---- group: Extract the tool call parameters
panel_6 = Panel("layout_json")  # disabled
panel_7 = Panel("room_name")  # disabled
panel_8 = Panel("width")  # disabled
gjok_9 = GetJSONObjectKey(JObject=decall_2.Arguments, Key=panel_6)  # disabled
gjok_10 = GetJSONObjectKey(JObject=decall_2.Arguments, Key=panel_7)  # disabled
gjok_11 = GetJSONObjectKey(JObject=decall_2.Arguments, Key=panel_8)  # disabled
rjv_9 = ReadJSONValue(JValue=gjok_9)  # -> AsString, AsNumber, AsBool; disabled

# ----
panel_9 = Panel("E:\IAAC Local GIT Repositories\AIA26_Studio\team_03\layout\layout_clean.json")

# ---- group: Input Layout
json_file_path = FilePath(panel_5)
json2string = Python3Script(path=json_file_path)  # -> out, json_string
# ---------- json2string: Python ----------
import sys
import json
from pathlib import Path


def read_json_as_string(path):
    path = Path(path)

    if not path.exists():
        raise FileNotFoundError(f"File not found: {file_path}")

    with open(path, "r", encoding="utf-8") as f:
        data = json.load(f)

    # Convert JSON object back to string
    json_string = json.dumps(data)

    return json_string

json_string = read_json_as_string(path)
# ---------- end json2string ----------

# ---- group: Get a Specific Room
py3 = Python3Script(json_str=rjv_9.AsString, room_name=gjok_10)  # -> out, a; inputs room_name: String; disabled
# ---------- py3: Python ----------
import json
import Rhino.Geometry as rg

# Inputs:
# json_str -> JSON as string
# room_name -> e.g. "Living Room"

def load_json_from_string(json_string):
    try:
        data = json.loads(json_string)
    except Exception as e:
        raise ValueError(f"Invalid JSON string: {e}")
    return data

def create_polyline(points):
    pts = [rg.Point3d(x, y, 0) for x, y in points]

    # Ensure closed
    if pts[0] != pts[-1]:
        pts.append(pts[0])

    return rg.Polyline(pts).ToPolylineCurve()

# Load JSON
data = load_json_from_string(json_str)

# Find the room
room_curve = None

for room in data.get("rooms", []):
    if room.get("name") == room_name:
        geometry = room.get("geometry")
        if geometry:
            room_curve = create_polyline(geometry)
        break

# Output ONLY the polyline
a = room_curve
# ---------- end py3 ----------

# ----
crv = Curve([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])

py3_2 = Python3Script(room_name=rjv_8.AsString)  # -> point
# ---------- py3_2: Python ----------
import json
import Rhino.Geometry as rg

path = r"E:\IAAC Local GIT Repositories\AIA26_Studio\team_03\python\layout.json"

# Debug
print("room_name received:", room_name)
print("type:", type(room_name))

if room_name is None:
    point = None
else:
    clean_name = str(room_name).strip().strip('"')
    
    with open(path, "r") as f:
        data = json.load(f)

    target = None
    for room in data["rooms"]:
        if room["name"].lower() == clean_name.lower():
            pts = room["geometry"]
            x = sum(p[0] for p in pts) / len(pts)
            y = sum(p[1] for p in pts) / len(pts)
            target = rg.Point3d(x, y, 0)
            break

    point = target
# ---------- end py3_2 ----------
crv_2 = Curve([<curve referenced from the Rhino model> x21])
ivist = IsoVist(Plane=py3_2, Count="300", Radius=rjv_7.AsNumber, Obstacles=crv)  # -> Points, Distance, Index
pline = PolyLine(Vertices=ivist.Points, Closed=invert(False))
path = FilePath(panel_9)
srf = Surface(pline)
py3_3 = Python3Script(boundary=pline, path=path, current_room=rjv_8.AsString)  # -> a; inputs boundary: Curve
# ---------- py3_3: Python ----------
import Rhino.Geometry as rg
import json

with open(path, "r") as f:
    data = json.load(f)

results = {}
step = 1.0
total_isovist_pts = 0

room_inside_counts = {}
room_total_counts = {}

for room in data["rooms"]:
    name = room["name"]
    pts = room["geometry"]
    
    xs = [p[0] for p in pts]
    ys = [p[1] for p in pts]
    min_x, max_x = min(xs), max(xs)
    min_y, max_y = min(ys), max(ys)
    
    total = 0
    inside = 0
    
    x = min_x
    while x <= max_x:
        y = min_y
        while y <= max_y:
            pt = rg.Point3d(x, y, 0)
            result = boundary.Contains(pt, rg.Plane.WorldXY, 0.01)
            if result == rg.PointContainment.Inside:
                inside += 1
                total_isovist_pts += 1
            total += 1
            y += step
        x += step
    
    room_inside_counts[name] = inside
    room_total_counts[name] = total

for name in room_inside_counts:
    total = room_total_counts[name]
    inside = room_inside_counts[name]
    if name == current_room:
        results[name] = 100.0
    elif total > 0:
        results[name] = round((inside / total) * 100, 1)
    else:
        results[name] = 0.0

a = json.dumps({"visibility": results}, indent=2)
# ---------- end py3_3 ----------
panel_10 = Panel(py3_3)

# ---- group: Extractor Tool do map json to grasshopper data
extractor = Python3Script(json_str=json2string.json_string)  # -> out, outline_curve, room_names, room_curves, door_names, door_curves, window_names, window_curves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
# ---------- extractor: Python ----------
import json
import Rhino.Geometry as rg

def load_json_from_string(json_string):
    try:
        data = json.loads(json_string)
    except Exception as e:
        raise ValueError(f"Invalid JSON string: {e}")
    return data

def create_polyline(points, close=True):
    """Create a Rhino PolylineCurve from 2D points"""
    pts = [rg.Point3d(x, y, 0) for x, y in points]

    if close and pts[0] != pts[-1]:
        pts.append(pts[0])

    return rg.Polyline(pts).ToPolylineCurve()

def create_line(points):
    """Create a Rhino LineCurve from 2 points"""
    if len(points) != 2:
        return None
    p1 = rg.Point3d(points[0][0], points[0][1], 0)
    p2 = rg.Point3d(points[1][0], points[1][1], 0)
    return rg.LineCurve(p1, p2)

# Load JSON
layout = load_json_from_string(json_str)

# ------------------------
# ROOMS (polygons)
# ------------------------
room_names = []
room_curves = []

for room in layout.get("rooms", []):
    name = room.get("name")
    geometry = room.get("geometry")

    if name and geometry:
        curve = create_polyline(geometry, close=True)
        room_names.append(name)
        room_curves.append(curve)

# ------------------------
# DOORS (lines)
# ------------------------
door_names = []
door_curves = []

for door in layout.get("doors", []):
    name = door.get("name")
    geometry = door.get("geometry")

    if name and geometry:
        curve = create_line(geometry)
        if curve:
            door_names.append(name)
            door_curves.append(curve)

# ------------------------
# WINDOWS (lines)
# ------------------------
window_names = []
window_curves = []

for window in layout.get("windows", []):
    name = window.get("name")
    geometry = window.get("geometry")

    if name and geometry:
        curve = create_line(geometry)
        if curve:
            window_names.append(name)
            window_curves.append(curve)

# ------------------------
# FURNITURE (polygons)
# ------------------------
furniture_names = []
furniture_curves = []

for furn in layout.get("furniture", []):
    name = furn.get("name")
    geometry = furn.get("geometry")

    if name and geometry:
        curve = create_polyline(geometry, close=True)
        furniture_names.append(name)
        furniture_curves.append(curve)

# ------------------------
# MEP (polygons)
# ------------------------
mep_names = []
mep_curves = []

for m in layout.get("mep", []):
    name = m.get("name")
    geometry = m.get("geometry")

    if name and geometry:
        curve = create_polyline(geometry, close=True)
        mep_names.append(name)
        mep_curves.append(curve)

# ------------------------
# STRUCTURE (lines)
# ------------------------
structure_names = []
structure_curves = []

for s in layout.get("structure", []):
    name = s.get("name")
    geometry = s.get("geometry")

    if name and geometry:
        curve = create_line(geometry)
        if curve:
            structure_names.append(name)
            structure_curves.append(curve)

# ------------------------
# OUTLINE (optional)
# ------------------------
outline_curve = None
if "outline" in layout:
    outline_curve = create_polyline(layout["outline"], close=True)

# ------------------------
# OUTPUTS
# ------------------------
a = room_names
b = room_curves

c = door_names
d = door_curves

e = window_names
f = window_curves

g = furniture_names
h = furniture_curves

i = mep_names
j = mep_curves

k = structure_names
l = structure_curves

m = outline_curve
# ---------- end extractor ----------

# ----
panel_11 = Panel(json_file_path)
srf_2 = Surface(extractor.room_curves)

# ---- group: Labels
area_2 = Area(Geometry=srf_2)  # -> Area, Centroid
tag = TextTag(Location=area_2.Centroid, Text=extractor.room_names)

# ----
cjv = CreateJSONValue(Value=py3_3)
cjo = CreateJSONObject(Keys="visibility_result", Values=cjv)
respond = MCPToolResponse(Request=decall_6.Request, Content=cjo, IsError=False)

decall_7 = DeconstructToolCall()  # -> Request, Tool, Arguments; disabled
panel_12 = Panel("layout_json")  # disabled
panel_13 = Panel("room_name")  # disabled
gjok_12 = GetJSONObjectKey(JObject=decall_7.Arguments, Key=panel_12)  # disabled
gjok_13 = GetJSONObjectKey(JObject=decall_7.Arguments, Key=panel_13)  # disabled
rjv_10 = ReadJSONValue(JValue=gjok_12)  # -> AsString, AsNumber, AsBool; disabled

# ---- group: Delete a Space by name
py3_4 = Python3Script(json_str=rjv_10.AsString, room_name=gjok_13)  # -> out, a; inputs room_name: String; disabled
# ---------- py3_4: Python ----------
import json
import copy

# Inputs:
# json_str -> JSON as string
# room_name -> e.g. "Kitchen"

def load_json_from_string(json_string):
    try:
        data = json.loads(json_string)
    except Exception as e:
        raise ValueError(f"Invalid JSON string: {e}")
    return data

# Load JSON
data = load_json_from_string(json_str)

# Work on a copy
filtered = copy.deepcopy(data)

# ------------------------
# 1. Find room IDs to remove
# ------------------------
ids_to_remove = set()

for room in filtered.get("rooms", []):
    if room.get("name") == room_name:
        ids_to_remove.add(room.get("id"))

# ------------------------
# 2. Remove from rooms
# ------------------------
filtered["rooms"] = [
    r for r in filtered.get("rooms", [])
    if r.get("id") not in ids_to_remove
]

# ------------------------
# 3. Remove / clean DOORS
# (remove doors that connect to deleted rooms)
# ------------------------
filtered["doors"] = [
    d for d in filtered.get("doors", [])
    if not any(rid in ids_to_remove for rid in d.get("attributes", {}).get("connectsRooms", []))
]

# ------------------------
# 4. Remove WINDOWS linked to deleted rooms
# ------------------------
filtered["windows"] = [
    w for w in filtered.get("windows", [])
    if w.get("attributes", {}).get("roomId") not in ids_to_remove
]

# ------------------------
# 5. Remove FURNITURE linked to deleted rooms
# ------------------------
filtered["furniture"] = [
    f for f in filtered.get("furniture", [])
    if f.get("attributes", {}).get("roomId") not in ids_to_remove
]

# ------------------------
# 6. (Optional) MEP cleanup
# (only if tied to rooms — currently not in your schema)
# ------------------------
# Keeping all MEP elements for now

# ------------------------
# 7. STRUCTURE
# (typically global, so we keep it)
# ------------------------

# ------------------------
# Output ONLY as string
# ------------------------
a = json.dumps(filtered, indent=2)
# ---------- end py3_4 ----------

# ----
pjs = ParseJSONString(Text=py3_4.a)  # disabled
respond_2 = MCPToolResponse(Request=decall_7.Request, Content=pjs, IsError=False)  # disabled

path_curve_polyline = Curve(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)
explode = Explode(Curve=reparameterize(path_curve_polyline), Recursive=True)  # -> Segments, Vertices
len = Length(Curve=explode.Segments)
ma = MassAddition(Input=len)  # -> Result, PartialResults
division = Division(A=ma.PartialResults, B=ma.Result)
panel_14 = Panel("""2
1
.5""")

rjv_11 = ReadJSONValue(JValue=gjok_11)  # -> AsString, AsNumber, AsBool; disabled
panel_15 = Panel("2")  # disabled
division_2 = Division(A=rjv_11.AsNumber, B=panel_15)  # disabled

# ---- group: Design Logic to Add a Window
room_polyline = Data(py3.a)  # disabled
debrep = DeconstructBrep(Brep=room_polyline)  # -> Faces, Edges, Vertices; disabled
item = ListItem(List=debrep.Edges, Index=0, Wrap=True)  # disabled
midpt = CurveMiddle(Curve=item)  # disabled
X = UnitX(Factor=division_2)  # disabled
move_3 = Move(Geometry=midpt, Motion=expr("-x", X))  # -> Geometry, Transform; disabled
move_4 = Move(Geometry=midpt, Motion=X)  # -> Geometry, Transform; disabled
merge = Merge(Data1=move_4.Geometry, Data2=move_3.Geometry)  # disabled

# ---- group: Creates a Window Object
panel_16 = Panel("South Window")  # disabled
panel_17 = Panel("window-2")  # disabled
txt = Text(merge)  # disabled
window_object = Python3Script(element_id=panel_17, name=panel_16, geometry=txt)  # -> out, window_obj; inputs element_id: String, geometry: list; disabled
# ---------- window_object: Python ----------
import json

def parse_point_string(pt_str):
    """
    Converts '{3.5, 0, 0}' -> [3.5, 0.0]
    """
    # Remove braces and spaces
    cleaned = pt_str.strip().replace("{", "").replace("}", "")
    
    # Split into components
    parts = cleaned.split(",")
    
    if len(parts) < 2:
        raise ValueError(f"Invalid point format: {pt_str}")
    
    x = float(parts[0])
    y = float(parts[1])
    
    return [x, y]

def serialize_geometry(geometry_list):
    """
    Converts list of GH strings into [[x,y], [x,y]]
    """
    return [parse_point_string(pt) for pt in geometry_list]

# ------------------------
# Convert geometry
# ------------------------
serialized_geometry = serialize_geometry(geometry)

# Build window object
window_obj = {
    "id": element_id,
    "name": name,
    "geometry": serialized_geometry
}

# Optional attributes
if attributes:
    window_obj["attributes"] = attributes

# Output ONLY as JSON string
window_obj = json.dumps(window_obj, indent=2)
# ---------- end window_object ----------

# ---- group: Merge it to the original layout json
py3_5 = Python3Script(json_str=rjv_9.AsString, new_object=window_object.window_obj)  # -> out, updated_layout; disabled
# ---------- py3_5: Python ----------
import json
import copy

def load_json_from_string(json_string):
    try:
        return json.loads(json_string)
    except Exception as e:
        raise ValueError(f"Invalid JSON string: {e}")

def detect_object_type(obj):
    """
    Infer target list from object id prefix.
    """
    obj_id = obj.get("id", "").lower()

    if obj_id.startswith("window"):
        return "windows"
    elif obj_id.startswith("door"):
        return "doors"
    elif obj_id.startswith("furn") or obj_id.startswith("furniture"):
        return "furniture"
    elif obj_id.startswith("mep"):
        return "mep"
    elif obj_id.startswith("wall") or obj_id.startswith("structure"):
        return "structure"
    else:
        # default fallback (safe choice)
        return "windows"

# ------------------------
# Load inputs
# ------------------------
layout = load_json_from_string(json_str)
new_object = json.loads(new_object)  # assuming object comes as JSON string

# Work on copy
updated = copy.deepcopy(layout)

# ------------------------
# Detect target category
# ------------------------
target_key = detect_object_type(new_object)

# ------------------------
# Ensure list exists
# ------------------------
if target_key not in updated:
    updated[target_key] = []

# ------------------------
# Insert object
# ------------------------
updated[target_key].append(new_object)

# ------------------------
# Output JSON string
# ------------------------
updated_layout = json.dumps(updated, indent=2)
# ---------- end py3_5 ----------

# ----
pjs_2 = ParseJSONString(Text=py3_5.updated_layout)  # disabled
respond_3 = MCPToolResponse(Request=decall_2.Request, Content=pjs_2, IsError=False)  # disabled

panel_18 = Panel(area.Area)  # disabled
panel_19 = Panel(volume.Volume)  # disabled
cjv_2 = CreateJSONValue(Value=panel_18)  # disabled
cjv_3 = CreateJSONValue(Value=panel_19)  # disabled
merge_2 = Merge(Data1=flatten(py3_4.a), Data2=flatten(py3_5.updated_layout))  # disabled
panel_20 = Panel("area")  # disabled
panel_21 = Panel("volume")  # disabled
cjo_2 = CreateJSONObject(Keys=panel_20, Values=cjv_2)  # disabled
cjo_3 = CreateJSONObject(Keys=panel_21, Values=cjv_3)  # disabled
respond_4 = MCPToolResponse(Request=decall_3.Request, Content=cjo_3, IsError=False)  # disabled
respond_5 = MCPToolResponse(Request=decall_4.Request, Content=cjo_2, IsError=False)  # disabled

# ---- group: Extractor Tool do map json to grasshopper data
extractor_2 = Python3Script(json_str=merge_2)  # -> out, outline_curve, room_names, room_curves, door_names, door_curves, window_names, window_curves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; disabled; same code as extractor

# ---- group: Polylines
swatch = ColourSwatch(SwatchColor=RGB(167, 219, 44))  # disabled
swatch_2 = ColourSwatch(SwatchColor=RGB(4, 154, 184))  # disabled
srf_3 = Surface(extractor_2.room_curves)  # disabled
preview = CustomPreview(Geometry=srf_3, Material=[swatch, swatch_2])  # disabled

# ---- group: Windows
number_slider = Slider(5.4, range=0..10)  # disabled
swatch_3 = ColourSwatch(SwatchColor=RGB(56, 56, 56))  # disabled
data = Data(extractor_2.window_curves)  # disabled
previewlw = CustomPreviewLineweights(Geometry=data, Shader=swatch_3, Thickness=number_slider, Absolute=False)  # disabled

# ---- group: Labels
area_3 = Area(Geometry=srf_3)  # -> Area, Centroid; disabled
tag_2 = TextTag(Location=area_3.Centroid, Text=extractor_2.room_names)  # disabled

# ----
# CLUSTER 01 -  Team 03 Result Cluster
num = Number(Slider(0.61, range=0..1))
num_2 = Number(panel_14)

larger = LargerThan(FirstNumber=num, SecondNumber=division)  # -> LargerThan, OrEqualTo
eval = EvaluateCurve(Curve=reparameterize(path_curve_polyline), Parameter=num)  # -> Point, Tangent, Angle
ma_2 = MassAddition(Input=larger.LargerThan)  # -> Result, PartialResults
item_2 = ListItem(List=reverse(num_2), Index=ma_2.Result, Wrap=True)

multiplication = Multiplication(A=item_2, B="2")

sph = Sphere(Base=eval.Point, Radius=multiplication)
mesh = MeshBrep(
    Brep=sph,
    Settings={GridMaxCount=0, GridMinCount=16, JaggedSeams=False, MaxEdgeLength=0, MinEdgeLength=0.0001, MinTolerance=0, Refine=True, RefineAngle=0, RelativeTolerance=0.65, SimplePlanes=True, Tolerance=0})
brep = Brep(<brep referenced from the Rhino model>)
mmx = MeshMesh(MeshA=mesh, MeshB=brep)
lng = ListLength(List=mmx)
larger_2 = LargerThan(FirstNumber=lng, SecondNumber="1")  # -> LargerThan, OrEqualTo

filter = StreamFilter(Gate=larger_2.OrEqualTo, Stream0="\"accessible\"", Stream1="\"collision detected, please fix\"")

panel_22 = Panel(filter)

filter_2 = StreamFilter(
    Gate=larger_2.OrEqualTo,
    Stream0=ColourSwatch(SwatchColor=RGB(56, 224, 0)),
    Stream1=ColourSwatch(SwatchColor=RGB(224, 0, 0)))
preview_2 = CustomPreview(Geometry=sph, Material=filter_2)

panel_23 = Panel(filter)

parse_json_string = ParseJSONString(Text=panel_23)

cjv_4 = CreateJSONValue(Value=panel_23)
cjo_4 = CreateJSONObject(Keys="status", Values=cjv_4)
respond_6 = MCPToolResponse(Request=decall_5.Request, Content=parse_json_string, IsError=False)

fjs = FormatJsonString(JSONString=panel_23)

deconstruct_tool_call = DeconstructToolCall(Request=sift.Output2)  # -> Request, Tool, Arguments
get_json_object_key = GetJSONObjectKey(JObject=deconstruct_tool_call.Arguments, Key="room_name")
get_json_object_key_2 = GetJSONObjectKey(JObject=deconstruct_tool_call.Arguments, Key="start_room")

read_json_value = ReadJSONValue(JValue=get_json_object_key)  # -> AsString, AsNumber, AsBool
panel_24 = Panel(get_json_object_key)

# ---- group: Simulate Circulation
python_3_script = Python3Script(json_str=read_json_value.AsString, start_room=get_json_object_key_2)  # -> out, a; inputs start_room: String
# ---------- python_3_script: Python ----------
import json
import copy
from collections import deque

# Inputs:
# json_str -> JSON as string
# start_room -> e.g. "Entrance"

def load_json_from_string(json_string):
    try:
        if isinstance(json_string, str):
            json_string = json_string.strip()
            if json_string.startswith('"') and json_string.endswith('"'):
                json_string = json_string[1:-1]
            json_string = json_string.replace('\\"', '"')
            json_string = json_string.replace('\\/', '/')
            json_string = json_string.replace('\\n', '')
            json_string = json_string.replace('\\r', '')
            json_string = json_string.replace('\\t', '')
        data = json.loads(json_string)
    except Exception as e:
        raise ValueError(f"Invalid JSON string: {e}")
    return data

data = load_json_from_string(json_str)
layout = copy.deepcopy(data)

graph = {}
for room in layout.get("rooms", []):
    graph[room["id"]] = []

for door in layout.get("doors", []):
    connected = door.get("attributes", {}).get("connectsRooms", [])
    if len(connected) == 2:
        room_a, room_b = connected
        if room_a in graph: graph[room_a].append(room_b)
        if room_b in graph: graph[room_b].append(room_a)

start_id = None
for room in layout.get("rooms", []):
    if room.get("name", "").lower() == start_room.lower():
        start_id = room["id"]
        break

depth = {}
if start_id:
    queue = deque([(start_id, 0)])
    visited = set()
    while queue:
        current, d = queue.popleft()
        if current in visited:
            continue
        visited.add(current)
        depth[current] = d
        for neighbor in graph.get(current, []):
            if neighbor not in visited:
                queue.append((neighbor, d + 1))

def get_room_type(name):
    name = name.lower()
    if any(x in name for x in ["entrance", "foyer", "hall", "corridor", "lobby"]):
        return "circulation"
    if any(x in name for x in ["living", "lounge", "salon"]):
        return "living"
    if any(x in name for x in ["kitchen", "dining"]):
        return "service"
    if any(x in name for x in ["master", "ensuite"]):
        return "master_bedroom"
    if any(x in name for x in ["bedroom", "guest room"]):
        return "bedroom"
    if any(x in name for x in ["bath", "wc", "toilet", "shower"]):
        return "bathroom"
    if any(x in name for x in ["storage", "laundry", "utility"]):
        return "utility"
    return "other"

id_to_type = {}
for room in layout.get("rooms", []):
    id_to_type[room["id"]] = get_room_type(room.get("name", ""))

for room in layout.get("rooms", []):
    rid = room["id"]
    name = room.get("name", "")
    room_type = get_room_type(name)
    d = depth.get(rid, -1)
    connections = len(graph.get(rid, []))
    neighbor_types = [id_to_type.get(n, "other") for n in graph.get(rid, [])]

    issues = []
    score = 1
    reason = "good circulation"

    if connections == 0:
        issues.append("isolated: no connections")
        score = 3
        reason = "room is completely isolated with no door connections"

    else:
        if room_type == "circulation":
            if connections == 1:
                issues.append("dead end corridor")
                score = max(score, 2)
                reason = "corridor is a dead end — should connect to multiple spaces"

        elif room_type == "living":
            if connections == 1:
                issues.append("living room is a dead end")
                score = max(score, 2)
                reason = "living room only has one connection — limits flow"
            if d > 2:
                issues.append("living room too deep from entry")
                score = max(score, 3)
                reason = "living room is too far from the entrance — poor accessibility"
            elif d > 1:
                score = max(score, 2)
                reason = "living room is somewhat deep from entry"

        elif room_type == "service":
            if connections == 1:
                issues.append("kitchen is a dead end")
                score = max(score, 2)
                reason = "kitchen only has one connection — limits circulation"
            if d > 3:
                issues.append("kitchen very deep from entry")
                score = max(score, 3)
                reason = "kitchen is very deep from the entrance"
            elif d > 2:
                score = max(score, 2)
                reason = "kitchen is somewhat deep from entry"

        elif room_type == "master_bedroom":
            if connections > 1:
                issues.append("master bedroom used as corridor")
                score = max(score, 2)
                reason = "master bedroom has multiple connections — used as a through space which affects privacy"
            else:
                reason = "master bedroom is a private dead end — expected and correct"

        elif room_type == "bedroom":
            if connections > 1:
                issues.append("bedroom used as corridor")
                score = max(score, 2)
                reason = "bedroom has multiple connections — used as a through space which affects privacy"
            else:
                reason = "bedroom is a private dead end — expected and correct"

        elif room_type == "bathroom":
            only_connects_to_master = all(t == "master_bedroom" for t in neighbor_types)
            connects_to_generic_bedroom_only = (
                all(t == "bedroom" for t in neighbor_types)
                and not any(t == "master_bedroom" for t in neighbor_types)
            )
            connects_to_circulation = any(
                t in ["circulation", "living", "other"] for t in neighbor_types
            )
            if only_connects_to_master:
                reason = "ensuite bathroom connected only to master bedroom — expected and correct"
            elif connects_to_generic_bedroom_only:
                issues.append("bathroom only accessible through bedroom")
                score = max(score, 2)
                reason = "guest bathroom is only accessible through a private bedroom — privacy issue"
                if d > 3:
                    score = max(score, 3)
                    reason = "guest bathroom is deep and only accessible through a private bedroom — serious privacy issue"
            elif connects_to_circulation:
                reason = "bathroom accessible from shared circulation space — correct"
            else:
                score = max(score, 2)
                reason = "bathroom accessibility is unclear"

        elif room_type == "utility":
            if d > 4:
                issues.append("utility room very deep")
                score = max(score, 2)
                reason = "utility room is very deep from entry"
            else:
                reason = "utility room placement is acceptable"

    score_label = {1: "good", 2: "minor issue", 3: "serious issue"}[score]

    room.setdefault("attributes", {})
    room["attributes"]["circulation"] = {
        "room_type": room_type,
        "depth_from_entry": d,
        "connections": connections,
        "score": score,
        "score_label": score_label,
        "reason": reason,
        "issues": issues
    }

a = json.dumps(layout, indent=2)
# ---------- end python_3_script ----------

# ----
panel_25 = Panel(python_3_script.a)

parse_json_string_2 = ParseJSONString(Text=python_3_script.a)
mcp_tool_response = MCPToolResponse(Request=deconstruct_tool_call.Request, Content=parse_json_string_2, IsError=False)

or = GateOr(A=respond_4, B=respond_5, C=respond_2, D=respond_3, E=respond, F=respond_6, G=mcp_tool_response)
tool_call_success = ClusterOutput(or)
