# Grasshopper definition team_04_working.gh (Grasshopper 1.0.8)
# plug-ins: Swiftlet

# ----
# Connect MCP Tools to Decall and Update All Clusters
button = Button()
# IF SOMETHING IS NOT
# WORKING PRESS THIS
# BUTTON FIRST
toggle = BooleanToggle(True)
update_all_clusters = CSharpScript(update=button, recursive=toggle)  # -> out, A; inputs update: Boolean, recursive: Boolean, passwords: list of String, localPath: String
# ---------- update_all_clusters: C# ----------
using System;
using System.Collections;
using System.Collections.Generic;

using Rhino;
using Rhino.Geometry;

using Grasshopper;
using Grasshopper.Kernel;
using Grasshopper.Kernel.Data;
using Grasshopper.Kernel.Types;
using System.Windows.Forms;
using System.Linq;
/// <summary>
/// This class will be instantiated on demand by the Script component.
/// </summary>
public class Script_Instance : GH_ScriptInstance
{
  /// <summary>Print a String to the [Out] Parameter of the Script component.</summary>
  /// <param name="text">String to print.</param>
  private void Print(string text) { /* Implementation hidden. */ }
  /// <summary>Print a formatted String to the [Out] Parameter of the Script component.</summary>
  /// <param name="format">String format.</param>
  /// <param name="args">Formatting parameters.</param>
  private void Print(string format, params object[] args) { /* Implementation hidden. */ }
  /// <summary>Print useful information about an object instance to the [Out] Parameter of the Script component. </summary>
  /// <param name="obj">Object instance to parse.</param>
  private void Reflect(object obj) { /* Implementation hidden. */ }
  /// <summary>Print the signatures of all the overloads of a specific method to the [Out] Parameter of the Script component. </summary>
  /// <param name="obj">Object instance to parse.</param>
  private void Reflect(object obj, string method_name) { /* Implementation hidden. */ }

  /// <summary>Gets the current Rhino document.</summary>
  private readonly RhinoDoc RhinoDocument;
  /// <summary>Gets the Grasshopper document that owns this script.</summary>
  private readonly GH_Document GrasshopperDocument;
  /// <summary>Gets the Grasshopper script component that owns this script.</summary>
  private readonly IGH_Component Component;
  /// <summary>
  /// Gets the current iteration count. The first call to RunScript() is associated with Iteration==0.
  /// Any subsequent call within the same solution will increment the Iteration count.
  /// </summary>
  private readonly int Iteration;

  /// <summary>
  /// This procedure contains the user code. Input parameters are provided as regular arguments,
  /// Output parameters as ref arguments. You don't have to assign output parameters,
  /// they will have a default value.
  /// </summary>
  private void RunScript(
		bool update,
		bool recursive,
		List<string> passwords,
		string localPath,
		ref object A)
  {

    A = updateLog;
    if (update)
    {
      updateLog = new List<string>();
      _passwords = passwords;
      UpdateClusters(GrasshopperDocument, recursive, localPath);
    }

  }

  // <Custom additional code> 
  List<string> updateLog;
  List<String> _passwords;

  void UpdateClusters (GH_Document ghDoc, bool recursive, string localPath)
  {
    foreach (var obj in ghDoc.Objects)
    {
      var cluster = obj as Grasshopper.Kernel.Special.GH_Cluster;
      if (cluster != null)
      {
        var clusterPath = cluster.FilePath;
        if (!string.IsNullOrEmpty(clusterPath))
        {
          if (cluster.Synchronisation == Grasshopper.Kernel.Special.GH_Synchronisation.OutOfDate)
          {
            cluster.CreateFromFilePath(clusterPath);
            updateLog.Add("Updated: " + clusterPath);
          }
          else if (cluster.Synchronisation == Grasshopper.Kernel.Special.GH_Synchronisation.MissingReference)
          {
            string newPath = ReplacePath(localPath, clusterPath);
            if (!string.IsNullOrEmpty(newPath))
            {
              cluster.CreateFromFilePath(newPath);
              updateLog.Add("Replaced and updated: " + newPath);
            }
            else
            {
              updateLog.Add("Missing reference: " + clusterPath);
            }

          }
        }

        //Update recursively
        if (recursive)
        {
          GH_Document clusterDoc = GetClusterDoc(cluster);
          if (clusterDoc != null)
            UpdateClusters(clusterDoc, recursive, localPath);
        }
      }
    }
  }

  GH_Document GetClusterDoc(Grasshopper.Kernel.Special.GH_Cluster cluster)
  {
    //no pass needed
    var doc = cluster.Document(string.Empty);
    if (doc != null)
      return doc;

    //try passwords
    if (_passwords != null && _passwords.Any())
    {
      foreach (var pass in _passwords)
      {
        doc = cluster.Document(pass);
        if (doc != null)
          return doc;
      }
    }

    return null;
  }

  string ReplacePath(string localPath, string missingPath)
  {
    if (String.IsNullOrEmpty(missingPath) || string.IsNullOrEmpty(localPath))
      return null;
    else
    {
      string lastLocalPart = localPath.Split('\\').Last();
      string[] parts = missingPath.Split('\\');
      if (parts.Contains(lastLocalPart))
      {
        int i = Array.IndexOf(parts, lastLocalPart);
        string clusterPath = String.Join("\\", parts.Skip(i + 1));
        string result = String.Join("\\", localPath, clusterPath);
        return result;
      }
      else
        return null;
    }
  }
  // </Custom additional code> 
}
# ---------- end update_all_clusters ----------
connect_mcp_tools_to_decall = CSharpScript(nickname_From="Central MCP Server", nickname_To="Central DeCall", connect=button)  # -> out; inputs nickname_From: String, nickname_To: String, connect: Boolean
# ---------- connect_mcp_tools_to_decall: C# ----------
using System;
using System.Linq;
using Grasshopper;
using Grasshopper.Kernel;

public class Script_Instance : GH_ScriptInstance
{
    private void RunScript(string nickname_From, string nickname_To, bool connect)
    {
        if (!connect) return;
        Console.Write($"Attempting to connect outputs from '{nickname_From}' to '{nickname_To}'...");

        var ghDoc = Instances.ActiveCanvas?.Document;
        if (ghDoc == null) return;

        var compFrom = ghDoc.Objects
            .OfType<IGH_Component>()
            .FirstOrDefault(o => o.NickName == nickname_From);

        var compTo = ghDoc.Objects
            .OfType<IGH_Param>()
            .FirstOrDefault(o => o.NickName == nickname_To);

        if (compFrom != null && compTo != null)
        {
            ghDoc.ScheduleSolution(5, doc => Connect(doc, compFrom, compTo));
        }
    }

    // <Custom additional code> 
    private void Connect(GH_Document doc, IGH_Component compFrom, IGH_Param compTo)
    {
        if (compFrom == null || compTo == null) return;

        foreach (IGH_Param param in compFrom.Params.Output)
        {
            compTo.AddSource(param);
        }
    }
}
# ---------- end connect_mcp_tools_to_decall ----------
panel = Panel(connect_mcp_tools_to_decall)

c_script = CSharpScript()  # -> out, availablePort
# ---------- c_script: C# ----------
// Grasshopper Script Instance
// This script finds an available port on the local machine.
#region Usings
using System;
using System.Linq;
using System.Collections;
using System.Collections.Generic;
using System.Drawing;
using System.Net;
using System.Net.Sockets;

using Rhino;
using Rhino.Geometry;

using Grasshopper;
using Grasshopper.Kernel;
using Grasshopper.Kernel.Data;
using Grasshopper.Kernel.Types;
#endregion

public class Script_Instance : GH_ScriptInstance
{
    #region Notes
    /* 
      Members:
        RhinoDoc RhinoDocument
        GH_Document GrasshopperDocument
        IGH_Component Component
        int Iteration

      Methods (Virtual & overridable):
        Print(string text)
        Print(string format, params object[] args)
        Reflect(object obj)
        Reflect(object obj, string method_name)
    */
    #endregion

    private void RunScript(object start, object end, ref object availablePort)
    {
        // Use default values if parameters are not provided
        int startPort = (start != null && int.TryParse(start.ToString(), out int s)) ? s : 3001;
        int endPort = (end != null && int.TryParse(end.ToString(), out int e)) ? e : 3100;

        // Find an available port in the specified range
        try
        {
            availablePort = FindAvailablePortInRange(startPort, endPort);
            Print($"Available port found: {availablePort}");
        }
        catch (Exception ex)
        {
            Print($"Error: {ex.Message}");
            availablePort = null;
        }
    }

    /// <summary>
    /// Checks if a local TCP port is available for binding (i.e., not in use).
    /// Returns True if available, False otherwise.
    /// </summary>
    private bool IsPortAvailableForBind(int port)
    {
        try
        {
            // Create a new TCP socket
            using (Socket socket = new Socket(AddressFamily.InterNetwork, SocketType.Stream, ProtocolType.Tcp))
            {
                // Try to bind to the port on all interfaces (0.0.0.0)
                socket.Bind(new IPEndPoint(IPAddress.Any, port));
                // If successful, the socket is closed by the using statement and return True
                return true;
            }
        }
        catch (SocketException)
        {
            // If binding fails, it means the port is already in use
            return false;
        }
    }

    /// <summary>
    /// Finds an available port by letting the OS assign one.
    /// </summary>
    private int FindAvailablePort()
    {
        Socket socket = new Socket(AddressFamily.InterNetwork, SocketType.Stream, ProtocolType.Tcp);
        socket.Bind(new IPEndPoint(IPAddress.Any, 0)); // Bind to an available port assigned by the OS
        int availablePort = ((IPEndPoint)socket.LocalEndPoint).Port; // Get the assigned port number
        socket.Close(); // Close the socket
        return availablePort;
    }

    /// <summary>
    /// Finds the first available port in a given range.
    /// </summary>
    private int FindAvailablePortInRange(int start = 3001, int end = 3100)
    {
        for (int port = start; port <= end; port++)
        {
            if (IsPortAvailableForBind(port))
                return port;
        }
        throw new Exception($"No available ports found in the range {start}-{end}.");
    }
}
# ---------- end c_script ----------
team_04_definition_cluster = Team04DefinitionCluster()
panel_2 = Panel(c_script.availablePort)
central_mcp_server = MCPServer(Port=c_script.availablePort, Tools=team_04_definition_cluster, ServerName="Swiftlet")  # -> Parametric_shape_generator, Move, Rotate
get_tool_names = CSharpScript(x=team_04_definition_cluster)  # -> flatten(out)
# ---------- get_tool_names: C# ----------
// Grasshopper Script Instance
#region Usings
using System;
using System.Linq;
using System.Collections;
using System.Collections.Generic;
using System.Drawing;

using Rhino;
using Rhino.Geometry;

using Grasshopper;
using Grasshopper.Kernel;
using Grasshopper.Kernel.Data;
using Grasshopper.Kernel.Types;
#endregion

public class Script_Instance : GH_ScriptInstance
{
    #region Notes
    /* 
      Members:
        RhinoDoc RhinoDocument
        GH_Document GrasshopperDocument
        IGH_Component Component
        int Iteration

      Methods (Virtual & overridable):
        Print(string text)
        Print(string format, params object[] args)
        Reflect(object obj)
        Reflect(object obj, string method_name)
    */
    #endregion

    private void RunScript(object x)
    {
        dynamic dynamicX = x;
        Console.Write(dynamicX.Name);
    }
}
# ---------- end get_tool_names ----------
central_decall = Data([central_mcp_server.Parametric_shape_generator, central_mcp_server.Move, central_mcp_server.Rotate])
clean = CleanTree(RemoveNulls=True, RemoveInvalid=True, RemoveEmpty=False, Tree=central_decall)
team_04_result_cluster = Team04ResultCluster(tool_call_request=clean)  # -> tool_names_3, tool_call_success

# ----
# Tool Names from the Results Clusters
# Tool Names from the Definition Clusters
# These Two Clusters should be EXACTLY THE SAME
panel_3 = Panel(get_tool_names)
panel_4 = Panel(team_04_result_cluster.tool_names_3)

rec = DataRecorder(clean, DataLimit=-10, RecordData=True)
rec_2 = DataRecorder(team_04_result_cluster.tool_call_success, DataLimit=-10, RecordData=True)
response_ok = Panel(rec_2)
called_tool_name = Panel(rec)

# ----
# Debug Tool Names
# This Panel should always be TRUE
tool_names_from_the_results_clusters = Data(panel_4)
tool_names_from_the_definition_clusters = Data(panel_3)
join = TextJoin(Text=flatten(tool_names_from_the_definition_clusters))
join_2 = TextJoin(Text=flatten(tool_names_from_the_results_clusters))
tstat = TreeStatistics(Tree=tool_names_from_the_definition_clusters)  # -> Paths, Length, Count
tstat_2 = TreeStatistics(Tree=tool_names_from_the_results_clusters)  # -> Paths, Length, Count
dpath = DeconstructPath(Branch=tstat.Paths)
dpath_2 = DeconstructPath(Branch=tstat_2.Paths)
equals = Equality(FirstNumber=tstat.Length, SecondNumber=tstat_2.Length)  # -> Equality, Inequality
equals_2 = Equality(FirstNumber=tstat.Count, SecondNumber=tstat_2.Count)  # -> Equality, Inequality
ma = MassAddition(Input=flatten(equals.Equality))  # -> Result, PartialResults
equals_3 = Equality(FirstNumber=dpath, SecondNumber=dpath_2)  # -> Equality, Inequality
lng = ListLength(List=equals.Equality)
ma_2 = MassAddition(Input=flatten(equals_3.Inequality))  # -> Result, PartialResults
equals_4 = Equality(FirstNumber=ma.Result, SecondNumber=lng)  # -> Equality, Inequality
does_quantity_of_tools_match = Panel(equals_2.Equality)
equals_5 = Equality(FirstNumber=ma_2.Result, SecondNumber="0")  # -> Equality, Inequality
does_quantity_of_tools_match_per_team = Panel(equals_4.Equality)
are_all_teams_included = Panel(equals_5.Equality)

tmatch = MatchText(Text=join, Pattern=join_2, Case=True)

do_all_names_match = Panel(tmatch)
and = GateAnd(A=equals_5.Equality, B=equals_4.Equality, C=equals_2.Equality, D=tmatch)  # -> flatten(Result)
do_trees_match = Panel(and)

# ==== cluster Team04ResultCluster

siteboundary = Curve(<curve referenced from the Rhino model>)
# Team 04 Result Cluster
# CYLINDER TEAM
context = Brep([<brep referenced from the Rhino model> x3740])
road = Curve([<curve referenced from the Rhino model> x2])
surface = Surface(siteboundary)
surface_2 = Surface(road)
divide_domain² = DivideDomain²(Domain=surface, UCount=10, VCount=10)
isotrim = Isotrim(Surface=surface, Domain=divide_domain²)
area = Area(Geometry=isotrim)  # -> Area, Centroid
point_in_curve = PointInCurve(Point=area.Centroid, Curve=siteboundary)  # -> Relationship, Point
gene_pool = GenePool(Decimals=0, Maximum=70, Minimum=0, Value=[25, 38, 31, 35, 48, 0, 22, 39, 35, 33])
cull_pattern = CullPattern(List=area.Centroid, CullPattern=point_in_curve.Relationship)  # -> flatten(List)
cull_pattern_2 = CullPattern(List=area.Centroid, CullPattern=point_in_curve.Relationship)
list_item = ListItem(List=cull_pattern_2, Index=gene_pool, Wrap=False)
flatten_tree = FlattenTree(Tree=cull_pattern_2, Path="{0}")

# ----
# Edit Tool Names to
# Match Definition Cluster
tool_names = Panel("""parametric_shape_generator
move
Rotate""")

# ----
# Sorting Logic, Please Do Not Edit
tool_call_request = ClusterInput()
tool_names_2 = Text(tool_names)
decall = DeconstructToolCall(Request=tool_call_request)  # -> Request, Tool, Arguments
mindex = MemberIndex(Set=tool_names, Member=decall.Tool)  # -> Index, Count

# ---- group: Cluster Output
tool_names_3 = ClusterOutput(tool_names_2)

# ----
sift = SiftPattern(List=decall.Request, SiftPattern=mindex.Index)  # -> Output0, Output1, Output2
deconstruct_tool_call = DeconstructToolCall(Request=sift.Output0)  # -> Request, Tool, Arguments
deconstruct_tool_call_2 = DeconstructToolCall(Request=sift.Output1)  # -> Request, Tool, Arguments
get_json_object_key = GetJSONObjectKey(JObject=deconstruct_tool_call.Arguments, Key="tree_sizes")
get_json_object_key_2 = GetJSONObjectKey(JObject=deconstruct_tool_call.Arguments, Key="tree_points")
get_json_object_key_3 = GetJSONObjectKey(JObject=deconstruct_tool_call.Arguments, Key="iterations")
get_json_object_key_4 = GetJSONObjectKey(JObject=deconstruct_tool_call.Arguments, Key="seed")
get_json_object_key_5 = GetJSONObjectKey(JObject=deconstruct_tool_call.Arguments, Key="genes_json")
get_json_object_key_6 = GetJSONObjectKey(JObject=deconstruct_tool_call.Arguments, Key="locked_shape_type")
get_json_object_key_7 = GetJSONObjectKey(JObject=deconstruct_tool_call.Arguments, Key="tree_count")
get_json_object_key_8 = GetJSONObjectKey(JObject=deconstruct_tool_call_2.Arguments, Key="Left")
read_json_value = ReadJSONValue(JValue=get_json_object_key_2)  # -> AsString, AsNumber, AsBool
read_json_value_2 = ReadJSONValue(JValue=get_json_object_key_7)  # -> AsString, AsNumber, AsBool
read_json_value_3 = ReadJSONValue(JValue=get_json_object_key)  # -> AsString, AsNumber, AsBool
get_json_object_key_9 = GetJSONObjectKey(JObject=deconstruct_tool_call_2.Arguments, Key="Right")
read_json_value_4 = ReadJSONValue(JValue=get_json_object_key_6)  # -> AsString, AsNumber, AsBool
read_json_value_5 = ReadJSONValue(JValue=get_json_object_key_3)  # -> AsString, AsNumber, AsBool
read_json_value_6 = ReadJSONValue(JValue=get_json_object_key_4)  # -> AsString, AsNumber, AsBool
read_json_value_7 = ReadJSONValue(JValue=get_json_object_key_5)  # -> AsString, AsNumber, AsBool
get_json_object_key_10 = GetJSONObjectKey(JObject=deconstruct_tool_call_2.Arguments, Key="Up")
get_json_object_key_11 = GetJSONObjectKey(JObject=deconstruct_tool_call_2.Arguments, Key="Down")
read_json_value_8 = ReadJSONValue(JValue=get_json_object_key_8)  # -> AsString, AsNumber, AsBool
read_json_value_9 = ReadJSONValue(JValue=get_json_object_key_9)  # -> AsString, AsNumber, AsBool
read_json_value_10 = ReadJSONValue(JValue=get_json_object_key_10)  # -> AsString, AsNumber, AsBool
read_json_value_11 = ReadJSONValue(JValue=get_json_object_key_11)  # -> AsString, AsNumber, AsBool
panel = Panel(read_json_value.AsString)
panel_2 = Panel(read_json_value_2.AsString)
panel_3 = Panel(read_json_value_3.AsString)
panel_4 = Panel(read_json_value_7.AsString)
script = Script(
    genes_json=read_json_value_7.AsString,
    locked_shape_type=read_json_value_4.AsString,
    site_boundary=siteboundary,
    tree_points=read_json_value.AsString,
    tree_count=read_json_value_2.AsString,
    tree_sizes=read_json_value_3.AsString,
    iterations=read_json_value_5.AsString,
    seed=read_json_value_6.AsString)  # -> mesh, vertices, faces, metadata, genes_payload, error
# ---------- script: Python ----------
"""
Grasshopper Python component - generative design optimizer.

Inputs to create in Grasshopper:
- genes_json or genes: JSON string or dictionary with the user request / seed genes
- iterations: number of candidates to evaluate
- seed: optional integer random seed
- locked_shape_type: optional override for typology lock
- site_boundary: optional site boundary polygon or boundary payload
- tree_points: optional list of tree positions for overlap penalties
- tree_sizes: optional list of tree size values aligned with tree_points
- tree_count: optional tree count used when points/sizes are provided as strings or omitted

Example genes:
{
  "shape_type": "u_shape",
  "length": 40,
  "width": 30,
  "height": 15,
  "rotation": 45
}

Outputs:
- mesh: Rhino mesh for the best candidate
- vertices: text summary of vertices
- faces: text summary of faces
- metadata: fitness summary text
- genes_payload: normalized best genes JSON
- error: error message if any
"""

from __future__ import annotations

import importlib
import json
import math
import random
import sys
from typing import Any

mesh = None
vertices = None
faces = None
metadata = None
genes_payload = None
error = None


def _coerce_text(value: Any) -> str:
    if value is None:
        return ""
    if hasattr(value, "ToString"):
        value = value.ToString()
    return str(value)


def _is_null_like_text(value: Any) -> bool:
    if value is None:
        return True
    if not isinstance(value, str):
        return False
    text = value.strip().lower()
    return text in {"", "null", "none", "undefined", "nan"}


def _coerce_payload(value: Any) -> dict[str, Any]:
    if value is None:
        return {}
    if isinstance(value, dict):
        payload = dict(value)
        raw_shape_type = payload.get("shape_type")
        if raw_shape_type is None or _is_null_like_text(raw_shape_type):
            payload.pop("shape_type", None)
        if not payload or (len(payload) == 1 and payload.get("shape_type") is None):
            return {}
        return payload
    if hasattr(value, "ToString"):
        value = value.ToString()
    if not isinstance(value, str):
        value = str(value)
    value = value.strip()
    if _is_null_like_text(value):
        return {}
    if value.startswith("{") or value.startswith("["):
        parsed = json.loads(value)
        if isinstance(parsed, dict):
            raw_shape_type = parsed.get("shape_type")
            if raw_shape_type is None or _is_null_like_text(raw_shape_type):
                parsed.pop("shape_type", None)
            if not parsed:
                return {}
            return parsed
        return {"genes_list": parsed}
    return {"shape_type": value}


def _coerce_list_payload(value: Any) -> list[Any]:
    if value is None:
        return []
    if isinstance(value, list):
        return value
    if hasattr(value, "ToString"):
        value = value.ToString()
    if not isinstance(value, str):
        value = str(value)
    value = value.strip()
    if _is_null_like_text(value):
        return []
    if value.startswith("["):
        parsed = json.loads(value)
        return parsed if isinstance(parsed, list) else []
    return []


def _coerce_int_payload(value: Any, default: int = 0) -> int:
    if value is None:
        return default
    if isinstance(value, bool):
        return int(value)
    if isinstance(value, int):
        return value
    if isinstance(value, float):
        return int(value)
    if hasattr(value, "ToString"):
        value = value.ToString()
    if not isinstance(value, str):
        value = str(value)
    text = value.strip()
    if not text:
        return default
    try:
        return int(float(text))
    except Exception:
        try:
            parsed = json.loads(text)
            if isinstance(parsed, (int, float)):
                return int(parsed)
        except Exception:
            pass
    return default


def _coerce_float_payload(value: Any, default: float = 0.0) -> float:
    if value is None:
        return default
    if isinstance(value, bool):
        return float(int(value))
    if isinstance(value, (int, float)):
        return float(value)
    if hasattr(value, "ToString"):
        value = value.ToString()
    if not isinstance(value, str):
        value = str(value)
    text = value.strip()
    if not text:
        return default
    try:
        return float(text)
    except Exception:
        try:
            parsed = json.loads(text)
            if isinstance(parsed, (int, float)):
                return float(parsed)
        except Exception:
            pass
    return default


def _has_meaningful_input(
    raw_payload: Any,
    shape_lock: Any,
    site_boundary: Any,
    tree_count: int,
    tree_points: Any,
    tree_sizes: Any,
) -> bool:
    if isinstance(raw_payload, dict):
        if raw_payload:
            if any(key in raw_payload for key in ("shape_type", "length", "width", "height", "rotation", "vertices", "arm_a_length", "arm_b_length", "wing_depth", "courtyard_size")):
                if any(not _is_null_like_text(raw_payload.get(key)) for key in raw_payload.keys() if key != "shape_type"):
                    return True
                if not _is_null_like_text(raw_payload.get("shape_type")) and str(raw_payload.get("shape_type")).strip().lower() != "rectangle":
                    return True
        else:
            raw_payload = None
    elif isinstance(raw_payload, str):
        if not _is_null_like_text(raw_payload):
            return True
    elif raw_payload not in (None, [], {}):
        return True
    if isinstance(shape_lock, str) and shape_lock.strip():
        return True
    if site_boundary:
        return True
    if tree_count > 0:
        return True
    if tree_points:
        return True
    if tree_sizes:
        return True
    return False


def _point_in_polygon(point: list[float], polygon: list[list[float]]) -> bool:
    x = float(point[0])
    y = float(point[1])
    inside = False
    count = len(polygon)
    for index in range(count):
        x1, y1 = polygon[index][0], polygon[index][1]
        x2, y2 = polygon[(index + 1) % count][0], polygon[(index + 1) % count][1]
        if ((y1 > y) != (y2 > y)) and (x < (x2 - x1) * (y - y1) / ((y2 - y1) or 1e-9) + x1):
            inside = not inside
    return inside


def _extract_site_boundary(raw_boundary: Any) -> list[list[float]]:
    if raw_boundary is None:
        return []
    boundary = raw_boundary
    if isinstance(boundary, dict):
        for key in ("boundary", "points", "vertices", "polyline"):
            if key in boundary:
                boundary = boundary[key]
                break
    if isinstance(boundary, list):
        points: list[list[float]] = []
        for item in boundary:
            if isinstance(item, (list, tuple)) and len(item) >= 2:
                points.append([float(item[0]), float(item[1])])
        return points
    return []


def _extract_tree_points(raw_trees: Any) -> list[list[float]]:
    if raw_trees is None:
        return []
    trees = raw_trees
    if isinstance(trees, dict):
        for key in ("trees", "points", "tree_points", "locations"):
            if key in trees:
                trees = trees[key]
                break
    if isinstance(trees, str):
        parsed = _coerce_list_payload(trees)
        trees = parsed if parsed else trees
    if isinstance(trees, list):
        points: list[list[float]] = []
        for item in trees:
            if hasattr(item, "ToString"):
                item = item.ToString()
            if isinstance(item, str):
                item_text = item.strip()
                if not item_text:
                    continue
                try:
                    parsed_item = json.loads(item_text)
                    item = parsed_item
                except Exception:
                    continue
            if isinstance(item, (list, tuple)) and len(item) >= 2:
                points.append([float(item[0]), float(item[1])])
        return points
    return []


def _extract_tree_sizes(raw_sizes: Any, tree_count: int) -> list[float]:
    if raw_sizes is None:
        return []
    sizes = raw_sizes
    if isinstance(sizes, dict):
        for key in ("sizes", "tree_sizes", "radii", "canopy_sizes"):
            if key in sizes:
                sizes = sizes[key]
                break
    if isinstance(sizes, str):
        parsed = _coerce_list_payload(sizes)
        sizes = parsed if parsed else sizes
    if isinstance(sizes, list):
        result: list[float] = []
        for item in sizes:
            if hasattr(item, "ToString"):
                item = item.ToString()
            try:
                result.append(float(item))
            except Exception:
                continue
        return result[:tree_count] if tree_count else result
    if isinstance(sizes, (int, float)):
        return [float(sizes)] * max(0, tree_count)
    return []


def _infer_tree_sizes_from_points(tree_points: list[list[float]]) -> list[float]:
    if not tree_points:
        return []

    y_values = [point[1] for point in tree_points if len(point) >= 2]
    if not y_values:
        return [5.0 for _ in tree_points]

    min_y = min(y_values)
    max_y = max(y_values)
    y_span = max(max_y - min_y, 1e-9)

    inferred_sizes: list[float] = []
    for point in tree_points:
        y_value = point[1] if len(point) >= 2 else min_y
        normalized = (y_value - min_y) / y_span
        inferred_sizes.append(round(4.5 + (normalized * 2.0), 2))
    return inferred_sizes


def _infer_tree_points_from_count(tree_count: int) -> list[list[float]]:
    if tree_count <= 0:
        return []
    if tree_count == 1:
        return [[0.5, 0.92]]
    if tree_count == 2:
        return [[0.333, 0.92], [0.667, 0.92]]
    return [[round((index + 1) / (tree_count + 1), 3), 0.92] for index in range(tree_count)]


def _evaluate_candidate(
    shape: Any,
    site_boundary: list[list[float]],
    tree_points: list[list[float]],
    tree_sizes: list[float],
) -> tuple[float, dict[str, float]]:
    area = float(shape.metadata.get("area", 0.0) or 0.0)
    volume = float(shape.metadata.get("volume", 0.0) or 0.0)
    perimeter = float(shape.metadata.get("perimeter", 0.0) or 0.0)
    bbox = shape.metadata.get("bounding_box", {})
    min_pt = bbox.get("min", [0.0, 0.0, 0.0])
    max_pt = bbox.get("max", [0.0, 0.0, 0.0])

    score = area + volume * 0.05 - perimeter * 0.1
    penalties = 0.0

    if site_boundary:
        outside_count = 0
        for vertex in shape.vertices_2d:
            if not _point_in_polygon(vertex, site_boundary):
                outside_count += 1
        boundary_penalty = outside_count * 500.0
        penalties += boundary_penalty

    if tree_points:
        overlap_penalty = 0.0
        for index, (tree_x, tree_y) in enumerate(tree_points):
            if min_pt[0] <= tree_x <= max_pt[0] and min_pt[1] <= tree_y <= max_pt[1]:
                size_factor = 1.0
                if index < len(tree_sizes):
                    try:
                        size_factor = max(0.5, float(tree_sizes[index]) / 5.0)
                    except Exception:
                        size_factor = 1.0
                overlap_penalty += 200.0 * size_factor
        penalties += overlap_penalty

    score -= penalties
    return score, {
        "area": area,
        "volume": volume,
        "perimeter": perimeter,
        "penalties": penalties,
        "score": score,
    }


def _build_mesh(rg_module: Any, vertices_3d: list[list[float]], face_indices: list[list[int]]) -> tuple[Any, int]:
    gh_mesh = rg_module.Mesh()
    for vertex in vertices_3d:
        gh_mesh.Vertices.Add(float(vertex[0]), float(vertex[1]), float(vertex[2]))

    face_count = 0
    for face in face_indices:
        if len(face) == 3:
            gh_mesh.Faces.AddFace(int(face[0]), int(face[1]), int(face[2]))
            face_count += 1
        elif len(face) == 4:
            gh_mesh.Faces.AddFace(int(face[0]), int(face[1]), int(face[2]), int(face[3]))
            face_count += 1
        elif len(face) > 4:
            for index in range(1, len(face) - 1):
                gh_mesh.Faces.AddFace(int(face[0]), int(face[index]), int(face[index + 1]))
                face_count += 1

    gh_mesh.Normals.ComputeNormals()
    gh_mesh.Compact()
    return gh_mesh, face_count


def load_shape_generator_module() -> Any:
    """Import or reload the VSCode shape generator module."""
    shape_module = importlib.import_module("shape_generator_node")
    return importlib.reload(shape_module)


def generate_shape_from_genes(generator: Any, genes: dict[str, Any], locked_shape_type: str | None, rng: random.Random) -> dict[str, Any]:
    """Create one candidate genes payload, respecting any typology lock."""
    return generator.generate_random_genes(
        shape_type=genes.get("shape_type"),
        locked_shape_type=locked_shape_type,
        overrides=genes,
        rng=rng,
    )


def apply_site_transform(shape: Any, genes: dict[str, Any]) -> Any:
    """Placeholder for site placement logic.

    The current generator already applies base_point and rotation inside the
    shape generator, so this function remains the hook for future site-specific
    transforms if you decide to add them later.
    """
    return shape


def convert_to_rhino_mesh(rg_module: Any, shape: Any) -> tuple[Any, int]:
    """Convert a generated shape into a Rhino mesh."""
    return _build_mesh(rg_module, shape.vertices_3d, shape.faces)


def run_generative_loop(
    rg_module: Any,
    generator: Any,
    seed_genes: dict[str, Any],
    seed_genes_obj: Any,
    iterations: int,
    locked_shape_type: str | None,
    site_boundary: list[list[float]],
    tree_points: list[list[float]],
    tree_sizes: list[float],
    rng: random.Random,
) -> tuple[Any, Any, int, dict[str, Any], Any, dict[str, float]]:
    """Run the optimization loop and return the best mesh and metadata."""
    best_candidate = None
    best_mesh = None
    best_face_count = 0
    best_score = -1.0e18
    best_metrics: dict[str, float] = {}
    best_shape = None

    for _ in range(iterations):
        candidate_genes = generate_shape_from_genes(
            generator=generator,
            genes=seed_genes,
            locked_shape_type=locked_shape_type,
            rng=rng,
        )

        shape = generator.generate_from_genes(candidate_genes)
        shape = apply_site_transform(shape, candidate_genes)
        score, metrics = _evaluate_candidate(shape, site_boundary, tree_points, tree_sizes)

        if best_candidate is None or score > best_score:
            best_candidate = candidate_genes
            best_score = score
            best_metrics = metrics
            best_mesh, best_face_count = convert_to_rhino_mesh(rg_module, shape)
            best_shape = shape

    if best_candidate is None or best_shape is None:
        raise RuntimeError("No valid candidates were generated")

    return best_mesh, best_shape, best_face_count, best_candidate, best_metrics, {"score": best_score}


try:
    py_folder = r"D:\3rd sem\STUDIO\AIA26_Studio - Copy (2)\team_04\PY"
    if py_folder not in sys.path:
        sys.path.insert(0, py_folder)

    rg = importlib.import_module("Rhino.Geometry")
    shape_module = load_shape_generator_module()
    ShapeGenerator = shape_module.ShapeGenerator
    ShapeGenes = shape_module.ShapeGenes

    rng = random.Random()
    seed_value = globals().get("seed")
    if seed_value is not None:
        try:
            rng.seed(int(seed_value))
        except Exception:
            rng.seed(str(seed_value))

    iterations_value = globals().get("iterations", 24)
    try:
        iterations = max(1, int(iterations_value))
    except Exception:
        iterations = 24

    raw_payload = globals().get("genes_json")
    if raw_payload is None:
        raw_payload = globals().get("genes")
    if raw_payload is None:
        raw_payload = globals().get("design_request")

    seed_genes = _coerce_payload(raw_payload)
    seed_genes_obj = ShapeGenes.from_dict(seed_genes)

    shape_lock = globals().get("locked_shape_type")
    if not shape_lock:
        shape_generation = _coerce_payload(globals().get("shape_generation"))
        shape_lock = shape_generation.get("locked_shape_type")
    if not shape_lock:
        shape_lock = seed_genes.get("shape_type")

    site_boundary = _extract_site_boundary(globals().get("site_boundary"))
    tree_count = _coerce_int_payload(globals().get("tree_count"), 0)
    if tree_count <= 0:
        tree_count = _coerce_int_payload(globals().get("number_of_trees"), 0)

    tree_points = _extract_tree_points(globals().get("tree_points"))
    if not tree_points:
        tree_points = _extract_tree_points(globals().get("tree_locations"))
    if not tree_points and tree_count > 0:
        tree_points = _infer_tree_points_from_count(tree_count)
    tree_sizes = _extract_tree_sizes(globals().get("tree_sizes"), len(tree_points))
    if not tree_sizes and tree_points:
        tree_sizes = _infer_tree_sizes_from_points(tree_points)
    if tree_sizes and len(tree_sizes) < len(tree_points):
        tree_sizes.extend([tree_sizes[-1]] * (len(tree_points) - len(tree_sizes)))
    elif len(tree_sizes) > len(tree_points):
        tree_sizes = tree_sizes[:len(tree_points)]

    if not _has_meaningful_input(raw_payload, shape_lock, site_boundary, tree_count, tree_points, tree_sizes):
        mesh = None
        vertices = None
        faces = None
        metadata = "No input provided."
        genes_payload = None
        error = "No generative input was provided to GRASSHOPPER_GENE_MESH.py."
    else:
        generator = ShapeGenerator(shape_id_prefix="GH")
        best_mesh, best_shape, best_face_count, best_candidate, best_metrics, fitness_info = run_generative_loop(
            rg_module=rg,
            generator=generator,
            seed_genes=seed_genes,
            seed_genes_obj=seed_genes_obj,
            iterations=iterations,
            locked_shape_type=shape_lock,
            site_boundary=site_boundary,
            tree_points=tree_points,
            tree_sizes=tree_sizes,
            rng=rng,
        )

        mesh = best_mesh
        vertices = "%d vertices" % len(best_shape.vertices_3d)
        faces = "%d faces" % best_face_count
        genes_payload = json.dumps(best_candidate, indent=2)
        metadata = (
            "Shape: {shape_type}\n"
            "Iterations: {iterations}\n"
            "Locked shape: {locked_shape}\n"
            "Area: {area:.2f}\n"
            "Volume: {volume:.2f}\n"
            "Perimeter: {perimeter:.2f}\n"
            "Penalties: {penalties:.2f}\n"
            "Fitness: {score:.2f}"
        ).format(
            shape_type=best_shape.shape_type,
            iterations=iterations,
            locked_shape=shape_lock or "none",
            area=best_metrics.get("area", 0.0),
            volume=best_metrics.get("volume", 0.0),
            perimeter=best_metrics.get("perimeter", 0.0),
            penalties=best_metrics.get("penalties", 0.0),
            score=fitness_info.get("score", 0.0),
        )

except Exception as exc:
    import traceback

    error = "ERROR: %s\n\n%s" % (exc, traceback.format_exc())
    mesh = None
    vertices = None
    faces = None
    metadata = None
    genes_payload = None
# ---------- end script ----------
panel_5 = Panel(script.error)
mesh_join = MeshJoin(Meshes=script.mesh)
panel_6 = Panel(script.mesh)
panel_7 = Panel(mesh_join)
script_2 = Script(
    site_crv=siteboundary,
    site_srf=surface,
    grid_pts=flatten_tree,
    building_mesh=flatten(mesh_join),
    road_crv=flatten(road),
    preferred_angle=Slider(90, range=0..100),
    iterations=read_json_value_5.AsString,
    tree_points=read_json_value.AsString,
    tree_count=read_json_value_2.AsString,
    tree_sizes=read_json_value_3.AsString)  # -> best_building, best_trees, best_index, best_angle, best_score, record, flatten(design_report); inputs site_crv: Curve, site_srf: Surface, grid_pts: list of Point3d, building_mesh: list of Mesh, road_crv: Curve, preferred_angle: Double, iterations: String, tree_points: String, tree_count: String, tree_sizes: String
# ---------- script_2: Python ----------
import Rhino.Geometry as rg
import rhinoscriptsyntax as rs
import random, math, json, ast

# -----------------------
# BASIC CONVERTERS
# -----------------------

def get_float(x, default):
    try:
        return float(x)
    except:
        return default

def get_int(x, default):
    try:
        return int(float(x))
    except:
        return default

def flatten_any(x):
    out = []

    if x is None:
        return out

    if hasattr(x, "Branches"):
        for b in x.Branches:
            out += flatten_any(b)
        return out

    if isinstance(x, (list, tuple)):
        for i in x:
            out += flatten_any(i)
        return out

    out.append(x)
    return out


def to_point3d(p):
    if isinstance(p, rg.Point3d):
        return p

    if isinstance(p, rg.Point):
        return p.Location

    try:
        cp = rs.coerce3dpoint(p)
        if cp:
            return cp
    except:
        pass

    if hasattr(p, "X") and hasattr(p, "Y") and hasattr(p, "Z"):
        return rg.Point3d(float(p.X), float(p.Y), float(p.Z))

    return None


def to_mesh(obj):
    if isinstance(obj, rg.Mesh):
        return obj.DuplicateMesh()

    if isinstance(obj, rg.Brep):
        meshes = rg.Mesh.CreateFromBrep(obj)

        if not meshes:
            return None

        joined = rg.Mesh()

        for m in meshes:
            joined.Append(m)

        joined.Normals.ComputeNormals()
        joined.Compact()

        return joined

    try:
        geo = rs.coercegeometry(obj)
        return to_mesh(geo)
    except:
        return None


def largest_mesh_piece(mesh):
    if mesh is None:
        return None

    try:
        pieces = mesh.SplitDisjointPieces()

        if pieces and len(pieces) > 0:
            largest = max(
                pieces,
                key=lambda m: m.GetBoundingBox(True).Diagonal.Length
            )

            largest.Normals.ComputeNormals()
            largest.Compact()

            return largest.DuplicateMesh()

    except:
        pass

    mesh.Normals.ComputeNormals()
    mesh.Compact()

    return mesh.DuplicateMesh()


def get_single_building_mesh(x):
    items = flatten_any(x)
    all_meshes = []

    for item in items:
        m = to_mesh(item)

        if m:
            all_meshes.append(largest_mesh_piece(m))

    if not all_meshes:
        return None

    biggest = max(
        all_meshes,
        key=lambda m: m.GetBoundingBox(True).Diagonal.Length
    )

    return biggest.DuplicateMesh()


# -----------------------
# CURVE HELPERS
# -----------------------

def get_curve(crv):
    if crv is None:
        return None

    if isinstance(crv, rg.Curve):
        return crv

    try:
        return rs.coercecurve(crv)
    except:
        return None


site_curve = get_curve(site_crv)
road_curve = get_curve(road_crv)


# -----------------------
# STRING PARSERS FOR TREE INPUTS
# -----------------------

def parse_tree_count(data, default=0):
    try:
        return int(float(str(data).strip()))
    except:
        return default


def parse_tree_sizes(data):
    sizes = []

    if data is None:
        return sizes

    try:
        parsed = ast.literal_eval(str(data))

        if isinstance(parsed, (list, tuple)):
            for item in parsed:
                try:
                    sizes.append(float(item))
                except:
                    pass
        else:
            sizes.append(float(parsed))

        return sizes

    except:
        pass

    try:
        parts = str(data).replace("[", "").replace("]", "").split(",")

        for p in parts:
            try:
                sizes.append(float(p.strip()))
            except:
                pass

    except:
        pass

    return sizes


def parse_tree_points(data):
    points = []

    if data is None:
        return points

    existing = flatten_any(data)

    for item in existing:
        pt = to_point3d(item)

        if pt:
            points.append(pt)

    if len(points) > 0:
        return points

    text = str(data).strip()

    try:
        parsed = ast.literal_eval(text)

        if isinstance(parsed, (list, tuple)):
            for item in parsed:

                if isinstance(item, (list, tuple)):

                    if len(item) == 2:
                        x = float(item[0])
                        y = float(item[1])
                        z = 0.0

                    elif len(item) >= 3:
                        x = float(item[0])
                        y = float(item[1])
                        z = float(item[2])

                    else:
                        continue

                    points.append(rg.Point3d(x, y, z))

        return points

    except:
        pass

    try:
        point_strings = text.split(";")

        for ps in point_strings:
            coords = ps.replace("[", "").replace("]", "").split(",")

            if len(coords) == 2:
                x = float(coords[0].strip())
                y = float(coords[1].strip())
                z = 0.0

            elif len(coords) >= 3:
                x = float(coords[0].strip())
                y = float(coords[1].strip())
                z = float(coords[2].strip())

            else:
                continue

            points.append(rg.Point3d(x, y, z))

    except:
        pass

    return points


# -----------------------
# INPUT SETTINGS
# -----------------------

iterations = get_int(iterations, 500)
preferred_angle = get_float(preferred_angle, 90.0)

tree_count = parse_tree_count(tree_count, 6)
tree_sizes_clean = parse_tree_sizes(tree_sizes)
tree_points_raw_clean = parse_tree_points(tree_points)

if iterations < 1:
    iterations = 500

if tree_count < 0:
    tree_count = 0

angles = [0, 45, 90, 135, 180, 225, 270, 315]
tol = 0.01

ROAD_WEIGHT = -1.0
SUN_WEIGHT = -1.0
OPEN_SPACE_WEIGHT = 1.0


# -----------------------
# SITE FUNCTIONS
# -----------------------

def point_inside_site_xy(pt):
    if site_curve is None:
        return False

    test = rg.Point3d(pt.X, pt.Y, 0)
    result = site_curve.Contains(test, rg.Plane.WorldXY, tol)

    return result != rg.PointContainment.Outside


def get_site_z_point(pt):
    test = rg.Point3d(pt.X, pt.Y, pt.Z)

    if site_srf is not None:
        try:
            if isinstance(site_srf, rg.Brep):
                result = site_srf.ClosestPoint(test)

                if isinstance(result, tuple) and result[0]:
                    return result[1]

            elif isinstance(site_srf, rg.Surface):
                ok, u, v = site_srf.ClosestPoint(test)

                if ok:
                    return site_srf.PointAt(u, v)

            elif isinstance(site_srf, rg.Mesh):
                mp = site_srf.ClosestMeshPoint(test, 999999)

                if mp:
                    return mp.Point
        except:
            pass

    return test


def snap_point_inside_site(pt, offset=2.0):
    if site_curve is None:
        return pt

    test = rg.Point3d(pt.X, pt.Y, 0)
    result = site_curve.Contains(test, rg.Plane.WorldXY, tol)

    if result != rg.PointContainment.Outside:
        return pt

    ok, t = site_curve.ClosestPoint(test)

    if not ok:
        return pt

    boundary_pt = site_curve.PointAt(t)
    bbox = site_curve.GetBoundingBox(True)
    center = bbox.Center

    inward_vec = rg.Vector3d(
        center.X - boundary_pt.X,
        center.Y - boundary_pt.Y,
        0
    )

    if inward_vec.Length > 0:
        inward_vec.Unitize()
        inward_vec *= offset

    return rg.Point3d(
        boundary_pt.X + inward_vec.X,
        boundary_pt.Y + inward_vec.Y,
        pt.Z
    )


def remap_normalized_tree_points(points):
    if site_curve is None:
        return points

    bbox = site_curve.GetBoundingBox(True)
    remapped = []

    for pt in points:

        if 0 <= pt.X <= 1 and 0 <= pt.Y <= 1:
            x = bbox.Min.X + pt.X * (bbox.Max.X - bbox.Min.X)
            y = bbox.Min.Y + pt.Y * (bbox.Max.Y - bbox.Min.Y)
            new_pt = rg.Point3d(x, y, 0.0)
        else:
            new_pt = pt

        new_pt = snap_point_inside_site(new_pt, 2.0)
        remapped.append(new_pt)

    return remapped


tree_points_clean = remap_normalized_tree_points(tree_points_raw_clean)


# -----------------------
# CLEAN INPUTS
# -----------------------

grid_pts_clean = []

for p in flatten_any(grid_pts):
    pt = to_point3d(p)

    if pt:
        grid_pts_clean.append(pt)

building_base = get_single_building_mesh(building_mesh)


# -----------------------
# TREE SIZE FUNCTION
# -----------------------

def get_tree_size(i):
    default_radius = 1.2
    default_height = 5.0

    if not tree_sizes_clean:
        return default_radius, default_height

    if len(tree_sizes_clean) == 1:
        return tree_sizes_clean[0], default_height

    if len(tree_sizes_clean) == len(tree_points_clean):
        return tree_sizes_clean[i], default_height

    pair_index = i * 2

    if pair_index + 1 < len(tree_sizes_clean):
        return tree_sizes_clean[pair_index], tree_sizes_clean[pair_index + 1]

    return tree_sizes_clean[i % len(tree_sizes_clean)], default_height


def mesh_inside_site(mesh):
    if mesh is None:
        return False

    bbox = mesh.GetBoundingBox(True)

    check_pts = [
        rg.Point3d(bbox.Min.X, bbox.Min.Y, 0),
        rg.Point3d(bbox.Max.X, bbox.Min.Y, 0),
        rg.Point3d(bbox.Max.X, bbox.Max.Y, 0),
        rg.Point3d(bbox.Min.X, bbox.Max.Y, 0),
        rg.Point3d(bbox.Center.X, bbox.Center.Y, 0)
    ]

    for pt in check_pts:
        if not point_inside_site_xy(pt):
            return False

    return True


# -----------------------
# BUILDING FUNCTIONS
# -----------------------

def move_mesh_to_point(mesh, target):
    m = mesh.DuplicateMesh()
    bbox = m.GetBoundingBox(True)

    center = bbox.Center
    target = get_site_z_point(target)

    vec = rg.Vector3d(
        target.X - center.X,
        target.Y - center.Y,
        target.Z - bbox.Min.Z
    )

    m.Transform(rg.Transform.Translation(vec))
    return m


def rotate_mesh(mesh, angle):
    m = mesh.DuplicateMesh()
    bbox = m.GetBoundingBox(True)

    center = rg.Point3d(
        bbox.Center.X,
        bbox.Center.Y,
        bbox.Min.Z
    )

    xform = rg.Transform.Rotation(
        math.radians(float(angle)),
        rg.Vector3d.ZAxis,
        center
    )

    m.Transform(xform)
    return m


def road_distance(mesh):
    if road_curve is None:
        return 0.0

    center = mesh.GetBoundingBox(True).Center
    ok, t = road_curve.ClosestPoint(center)

    if not ok:
        return 999999.0

    return center.DistanceTo(road_curve.PointAt(t))


def open_space_score(mesh):
    if site_curve is None:
        return 0.0

    center = mesh.GetBoundingBox(True).Center
    ok, t = site_curve.ClosestPoint(center)

    if not ok:
        return 0.0

    return center.DistanceTo(site_curve.PointAt(t))


def sun_diff(angle):
    d = abs(float(angle) - preferred_angle)
    return min(d, 360.0 - d)


def building_fitness(mesh, angle):
    score = 0.0
    score += road_distance(mesh) * ROAD_WEIGHT
    score += open_space_score(mesh) * OPEN_SPACE_WEIGHT
    score += sun_diff(angle) * SUN_WEIGHT
    return score


# -----------------------
# TREE FUNCTIONS
# -----------------------

def create_tree(pt, radius, height):
    base_pt = get_site_z_point(pt)

    plane = rg.Plane(base_pt, rg.Vector3d.ZAxis)
    circle = rg.Circle(plane, radius)
    cylinder = rg.Cylinder(circle, height)

    return rg.Brep.CreateFromCylinder(cylinder, True, True)


def tree_clear_from_building(pt, radius, mesh):
    if mesh is None:
        return False

    bbox = mesh.GetBoundingBox(True)
    safe_dist = radius * 2.0

    minx = bbox.Min.X - safe_dist
    maxx = bbox.Max.X + safe_dist
    miny = bbox.Min.Y - safe_dist
    maxy = bbox.Max.Y + safe_dist

    if minx <= pt.X <= maxx and miny <= pt.Y <= maxy:
        return False

    return True


def tree_tree_clear(pt, radius, existing_tree_data):
    for old_pt, old_radius in existing_tree_data:
        min_dist = (radius + old_radius) * 1.5

        if pt.DistanceTo(old_pt) < min_dist:
            return False

    return True


# -----------------------
# VALID GRID POINTS
# -----------------------

valid_pts = []

for pt in grid_pts_clean:
    if point_inside_site_xy(pt):
        valid_pts.append(get_site_z_point(pt))


# -----------------------
# FIND BEST BUILDING
# -----------------------

best_building = None
best_index = -1
best_angle = 0.0
best_score = -1e18

checked = 0
valid_buildings = 0

if site_curve and building_base and len(valid_pts) > 0:

    for i in range(iterations):

        idx = random.randint(0, len(valid_pts) - 1)
        angle = random.choice(angles)

        moved = move_mesh_to_point(building_base, valid_pts[idx])
        rotated = rotate_mesh(moved, angle)
        rotated = largest_mesh_piece(rotated)

        checked += 1

        if not mesh_inside_site(rotated):
            continue

        valid_buildings += 1

        score = building_fitness(rotated, angle)

        if score > best_score:
            best_score = score
            best_building = rotated.DuplicateMesh()
            best_index = idx
            best_angle = angle


# -----------------------
# PLACE TREES
# -----------------------

best_trees = []
tree_pts = []
tree_data = []
skipped_trees = []

if best_building is not None:

    for i, raw_pt in enumerate(tree_points_clean):

        if len(best_trees) >= tree_count:
            break

        pt = get_site_z_point(raw_pt)
        radius, height = get_tree_size(i)

        if radius <= 0:
            skipped_trees.append("tree {} skipped: radius <= 0".format(i))
            continue

        if height <= 0:
            height = 5.0

        # keep point inside after Z adjustment
        pt = snap_point_inside_site(pt, 2.0)

        if not point_inside_site_xy(pt):
            skipped_trees.append("tree {} skipped: outside site".format(i))
            continue

        # disabled because tree radius may extend outside edge
        # if not tree_circle_inside_site(pt, radius * 1.2):
        #     skipped_trees.append("tree {} skipped: tree circle outside site".format(i))
        #     continue

        if not tree_clear_from_building(pt, radius, best_building):
            skipped_trees.append("tree {} skipped: too close to building".format(i))
            continue

        if not tree_tree_clear(pt, radius, tree_data):
            skipped_trees.append("tree {} skipped: too close to another tree".format(i))
            continue

        tree_pts.append(pt)
        tree_data.append((pt, radius))
        best_trees.append(create_tree(pt, radius, height))


# -----------------------
# FINAL OUTPUT
# -----------------------

if best_building is not None:
    best_building = largest_mesh_piece(best_building)

else:
    best_building = None
    best_trees = []
    tree_pts = []
    tree_data = []
    best_index = -1
    best_angle = 0.0
    best_score = -999999.0


record = json.dumps({
    "best_grid_index": int(best_index),
    "best_rotation_angle": float(best_angle),
    "best_fitness_score": float(best_score),
    "checked_options": int(checked),
    "valid_inside_buildings": int(valid_buildings),
    "valid_grid_point_count": int(len(valid_pts)),
    "tree_input_point_count": int(len(tree_points_clean)),
    "tree_size_count": int(len(tree_sizes_clean)),
    "trees_created": int(len(best_trees)),
    "requested_tree_count": int(tree_count),
    "remapped_tree_points": [[p.X, p.Y, p.Z] for p in tree_points_clean],
    "skipped_trees": skipped_trees,
    "note": "String tree inputs accepted. Normalized tree points are remapped and snapped inside site."
}, indent=4)


# -----------------------
# HUMAN DESIGN REPORT
# -----------------------

design_lines = []

design_lines.append("SITE OPTIMIZATION REPORT")
design_lines.append("----------------------------------")
design_lines.append("")

design_lines.append(
    "The building form was optimized by evaluating {} placement and rotation options.".format(
        checked
    )
)

design_lines.append(
    "{} valid building placements were found inside the site boundary.".format(
        valid_buildings
    )
)

design_lines.append("")

design_lines.append(
    "The selected building achieved the highest fitness score of {:.2f}.".format(
        best_score
    )
)

design_lines.append(
    "The final building was positioned using grid point index {}.".format(
        best_index
    )
)

design_lines.append(
    "The selected building orientation is {} degrees.".format(
        best_angle
    )
)

design_lines.append("")

design_lines.append(
    "Optimization considered:"
)

design_lines.append("- Site containment")
design_lines.append("- Open space generation")
design_lines.append("- Road accessibility")
design_lines.append("- Preferred sun orientation")
design_lines.append("- Tree collision avoidance")
design_lines.append("")

design_lines.append(
    "Tree placement analysis:"
)

design_lines.append(
    "- {} tree input points were received.".format(
        len(tree_points_clean)
    )
)

design_lines.append(
    "- {} trees were successfully created.".format(
        len(best_trees)
    )
)

design_lines.append(
    "- Requested tree count was {}.".format(
        tree_count
    )
)

if len(skipped_trees) > 0:

    design_lines.append("")
    design_lines.append(
        "Some trees were skipped due to optimization constraints:"
    )

    for s in skipped_trees:
        design_lines.append("- " + s)

design_lines.append("")

design_lines.append(
    "The final solution prioritizes buildable placement while maintaining spatial clearance from trees and maximizing usable site area."
)

design_lines.append("")

design_lines.append(
    "Optimization completed successfully."
)

design_report = "\n".join(design_lines)
# ---------- end script_2 ----------
number_slider = Slider(0, range=0..100)
panel_8 = Panel(script_2.best_building)
panel_9 = Panel(script_2.best_trees)
list_item_2 = ListItem(List=script_2.best_building, Index=number_slider, Wrap=True)
list_item_3 = ListItem(List=script_2.design_report, Index=number_slider, Wrap=True)
mesh = Mesh(script_2.best_trees)
mesh_2 = Mesh(list_item_2)
mesh_join_2 = MeshJoin(Meshes=mesh_2)
python_3_script = Python3Script(building_in=mesh_join_2, trees_in=mesh, reset=Toggle(False))  # -> building_out, trees_out, status; inputs building_in: Mesh, trees_in: list of Mesh
# ---------- python_3_script: Python ----------
import scriptcontext as sc
import Rhino.Geometry as rg

KEY_BUILDING = "LAST_VALID_BUILDING_AUTO"
KEY_TREES = "LAST_VALID_TREES_AUTO"

def is_valid_geo(g):
    if g is None:
        return False

    if isinstance(g, rg.Mesh):
        return g.IsValid and g.Vertices.Count > 0 and g.Faces.Count > 0

    if isinstance(g, rg.Brep):
        return g.IsValid and g.Faces.Count > 0

    if hasattr(g, "IsValid"):
        return g.IsValid

    return False

def duplicate_geo(g):
    if g is None:
        return None
    try:
        return g.Duplicate()
    except:
        pass
    try:
        return g.DuplicateMesh()
    except:
        pass
    try:
        return g.DuplicateBrep()
    except:
        pass
    return g

def flatten_input(x):
    result = []

    if x is None:
        return result

    if hasattr(x, "Branches"):
        for branch in x.Branches:
            for item in branch:
                result.append(item)
        return result

    try:
        for item in x:
            result.append(item)
        return result
    except:
        return [x]

if reset:
    sc.sticky.pop(KEY_BUILDING, None)
    sc.sticky.pop(KEY_TREES, None)

tree_list = flatten_input(trees_in)

valid_building = is_valid_geo(building_in)
valid_trees = [t for t in tree_list if is_valid_geo(t)]

# Store only when new valid input exists
if valid_building:
    sc.sticky[KEY_BUILDING] = duplicate_geo(building_in)

if len(valid_trees) > 0:
    sc.sticky[KEY_TREES] = [duplicate_geo(t) for t in valid_trees]

# If current input is null, use previous stored version
if valid_building:
    building_out = building_in
elif KEY_BUILDING in sc.sticky:
    building_out = duplicate_geo(sc.sticky[KEY_BUILDING])
else:
    building_out = None

if len(valid_trees) > 0:
    trees_out = valid_trees
elif KEY_TREES in sc.sticky:
    trees_out = [duplicate_geo(t) for t in sc.sticky[KEY_TREES]]
else:
    trees_out = []

status = (
    "Current building valid: {}\n"
    "Current tree count: {}\n"
    "Stored building exists: {}\n"
    "Stored tree count: {}\n"
    "Output tree count: {}"
).format(
    valid_building,
    len(valid_trees),
    KEY_BUILDING in sc.sticky,
    len(sc.sticky[KEY_TREES]) if KEY_TREES in sc.sticky else 0,
    len(trees_out)
)
# ---------- end python_3_script ----------
mesh_join_3 = MeshJoin(Meshes=python_3_script.building_out)
panel_10 = Panel(mesh_join_3)
python_3_script_2 = Python3Script(
    best_building=mesh_join_3,
    site_crv=siteboundary,
    tree_breps=python_3_script.trees_out,
    move_left=read_json_value_8.AsString,
    move_right=read_json_value_9.AsString,
    move_front=read_json_value_10.AsString,
    move_back=read_json_value_11.AsString,
    apply_move=Toggle(True))  # -> final_building, flatten(move_status), flatten(move_report); inputs move_back: tree
# ---------- python_3_script_2: Python ----------
import Rhino.Geometry as rg
import rhinoscriptsyntax as rs
import json
import ast

tol = 0.01

# -----------------------
# HELPERS
# -----------------------

def flatten_any(x):
    out = []
    if x is None:
        return out
    if hasattr(x, "Branches"):
        for b in x.Branches:
            out += flatten_any(b)
        return out
    if isinstance(x, (list, tuple)):
        for i in x:
            out += flatten_any(i)
        return out
    out.append(x)
    return out


def get_bool(x):
    try:
        return bool(x)
    except:
        return False


def parse_input_value(x, key):
    if x is None:
        return 0.0

    items = flatten_any(x)

    for item in items:
        try:
            return float(item)
        except:
            pass

        text = str(item).strip()

        try:
            data = json.loads(text)
            if isinstance(data, dict) and key in data:
                return float(data[key])
        except:
            pass

        try:
            data = ast.literal_eval(text)
            if isinstance(data, dict) and key in data:
                return float(data[key])
        except:
            pass

    return 0.0


def get_curve(x):
    if isinstance(x, rg.Curve):
        return x
    try:
        return rs.coercecurve(x)
    except:
        return None


def to_mesh(obj):
    if isinstance(obj, rg.Mesh):
        return obj.DuplicateMesh()

    if isinstance(obj, rg.Brep):
        meshes = rg.Mesh.CreateFromBrep(obj)
        if not meshes:
            return None

        joined = rg.Mesh()
        for m in meshes:
            joined.Append(m)

        joined.Normals.ComputeNormals()
        joined.Compact()
        return joined

    try:
        geo = rs.coercegeometry(obj)
        return to_mesh(geo)
    except:
        return None


def get_building_mesh(x):
    meshes = []

    for item in flatten_any(x):
        m = to_mesh(item)
        if m:
            meshes.append(m)

    if not meshes:
        return None

    return max(meshes, key=lambda m: m.GetBoundingBox(True).Diagonal.Length)


def get_tree_meshes(x):
    meshes = []

    for item in flatten_any(x):
        m = to_mesh(item)
        if m:
            meshes.append(m)

    return meshes


# -----------------------
# VALIDATION
# -----------------------

def inside_site(mesh, site_curve):
    if mesh is None or site_curve is None:
        return False, "Missing building or site boundary."

    outside_count = 0

    for v in mesh.Vertices:
        pt = rg.Point3d(v.X, v.Y, 0)

        result = site_curve.Contains(
            pt,
            rg.Plane.WorldXY,
            tol
        )

        if result == rg.PointContainment.Outside:
            outside_count += 1

    if outside_count > 0:
        return False, "Move rejected because {} building vertex point(s) would go outside the site boundary.".format(outside_count)

    return True, "Moved building remains inside the site boundary."


def overlaps_tree(mesh, tree_meshes):
    overlap_count = 0

    for tree in tree_meshes:
        try:
            inter = rg.Intersect.Intersection.MeshMeshFast(mesh, tree)
            if inter is not None and len(inter) > 0:
                overlap_count += 1
        except:
            pass

    if overlap_count > 0:
        return True, "Move rejected because building would overlap {} tree zone(s).".format(overlap_count)

    return False, "No tree overlap detected."


# -----------------------
# INPUTS
# -----------------------

site_curve = get_curve(site_crv)
building = get_building_mesh(best_building)
tree_meshes = get_tree_meshes(tree_breps)

left_dist = parse_input_value(move_left, "move_left")
right_dist = parse_input_value(move_right, "move_right")
front_dist = parse_input_value(move_front, "move_front")
back_dist = parse_input_value(move_back, "move_back")

run_move = get_bool(apply_move)

# -----------------------
# DEFAULT OUTPUTS
# -----------------------

final_building = building
move_status = "not_applied"
move_report = "Movement tool did not run."

# -----------------------
# FIND MOVEMENT
# Priority: left → right → front → back
# -----------------------

move_vec = rg.Vector3d(0, 0, 0)
direction_used = "none"
distance_used = 0.0

if left_dist > 0:
    move_vec = rg.Vector3d(-left_dist, 0, 0)
    direction_used = "left"
    distance_used = left_dist

elif right_dist > 0:
    move_vec = rg.Vector3d(right_dist, 0, 0)
    direction_used = "right"
    distance_used = right_dist

elif front_dist > 0:
    move_vec = rg.Vector3d(0, front_dist, 0)
    direction_used = "front"
    distance_used = front_dist

elif back_dist > 0:
    move_vec = rg.Vector3d(0, -back_dist, 0)
    direction_used = "back"
    distance_used = back_dist


# -----------------------
# APPLY MOVE
# -----------------------

if building is None:

    final_building = None
    move_status = "failed"
    move_report = "Move failed because no optimized building was received."

elif not run_move:

    final_building = building
    move_status = "not_applied"
    move_report = "apply_move is False. Optimized building remains unchanged."

elif direction_used == "none":

    final_building = building
    move_status = "not_applied"
    move_report = json.dumps({
        "status": "not_applied",
        "reason": "No movement value was received.",
        "expected_inputs": {
            "move_left": "positive number or {'move_left': 5}",
            "move_right": "positive number or {'move_right': 5}",
            "move_front": "positive number or {'move_front': 5}",
            "move_back": "positive number or {'move_back': 5}"
        }
    }, indent=4)

else:

    moved = building.DuplicateMesh()
    moved.Transform(rg.Transform.Translation(move_vec))

    site_ok, site_msg = inside_site(moved, site_curve)
    tree_hit, tree_msg = overlaps_tree(moved, tree_meshes)

    if site_ok and not tree_hit:

        final_building = moved
        move_status = "accepted"

        move_report = json.dumps({
            "status": "accepted",
            "direction": direction_used,
            "distance": distance_used,
            "vector": [move_vec.X, move_vec.Y, move_vec.Z],
            "site_check": site_msg,
            "tree_check": tree_msg,
            "result": "Building moved successfully."
        }, indent=4)

    else:

        final_building = building
        move_status = "rejected"

        reasons = []

        if not site_ok:
            reasons.append(site_msg)

        if tree_hit:
            reasons.append(tree_msg)

        move_report = json.dumps({
            "status": "rejected",
            "direction": direction_used,
            "distance": distance_used,
            "vector": [move_vec.X, move_vec.Y, move_vec.Z],
            "reasons": reasons,
            "result": "Original optimized building kept."
        }, indent=4)
# ---------- end python_3_script_2 ----------
create_json_value = CreateJSONValue(Value=list_item_3)
panel_11 = Panel(mesh_2)
mesh_3 = Mesh(python_3_script_2.final_building)
panel_12 = Panel(python_3_script_2.move_report)
panel_13 = Panel(python_3_script.building_out)
list_item_4 = ListItem(List=python_3_script_2.move_report, Index=0, Wrap=False)
create_json_object = CreateJSONObject(Keys="parametric_shape_generator", Values=create_json_value)
create_json_value_2 = CreateJSONValue(Value=list_item_4)
panel_14 = Panel(list_item_3)
create_json_object_2 = CreateJSONObject(Keys="move", Values=create_json_value_2)
panel_15 = Panel(create_json_value_2)
mcp_tool_response = MCPToolResponse(Request=deconstruct_tool_call_2.Request, Content=create_json_object_2, IsError=False)
mcp_tool_response_2 = MCPToolResponse(Request=deconstruct_tool_call.Request, Content=create_json_object, IsError=False)
or = GateOr(A=mcp_tool_response_2, B=mcp_tool_response)
tool_call_success = ClusterOutput(or)

# ==== cluster Team04DefinitionCluster
panel = Panel("Radius or size of each tree canopy/buffer zone. Used to control tree collision distance from the building.")
panel_2 = Panel("Site boundary geometry used for placement and constraint checking. Defines the allowable region for building and tree generation.")
panel_3 = Panel("Tree location coordinates, usually as X,Y,Z points. Used as fixed tree positions on the site.")
panel_4 = Panel("Number of generative design candidates evaluated during optimization. Higher values increase exploration quality but also increase computation time.")
# Team 04 Definition Cluster
# CYLINDER TEAM
panel_5 = Panel("Text / JSON String")
panel_6 = Panel("Random seed value used to reproduce the same generative results consistently across runs. Changing the seed creates different design variations.")
panel_7 = Panel("Optional building typology lock. Example values: h_shape, l_shape, u_shape, courtyard, tower. When connected, the system only generates variations of this selected shape type.")
panel_8 = Panel("Rotate the optimized building anti-clockwise by a specified degree value around the Z-axis while validating site boundary and tree constraints.")
panel_9 = Panel("JSON data coming from VS Code or MCP containing all generated gene values for the building configuration, optimization parameters, and generative rules.")
panel_10 = Panel("Rotate the optimized building clockwise by a specified degree value around the Z-axis while keeping the building inside the site boundary.")
panel_11 = Panel("Generates procedural site boundaries using area, proportion, distortion, subdivision, and rotation parameters.")
define_tool_parameter = DefineToolParameter(Name="tree_sizes", Type="Number / Float", Description=panel, Required=Toggle(True))
define_tool_parameter_2 = DefineToolParameter(
    Name="tree_count",
    Type="Number / Integer",
    Description="Total number of trees to generate or place on the site.",
    Required=Toggle(True))
define_tool_parameter_3 = DefineToolParameter(Name="locked_shape_type", Type="Text", Description=panel_7, Required=Toggle(True))
define_tool_parameter_4 = DefineToolParameter(Name="site_boundary", Type="Curve / Polyline / Point List", Description=panel_2, Required=Toggle(True))
define_tool_parameter_5 = DefineToolParameter(Name="genes_json", Type=panel_5, Description=panel_9, Required=Toggle(True))
define_tool_parameter_6 = DefineToolParameter(Name="tree_points", Type="Point / Coordinate List/Number", Description=panel_3, Required=Toggle(True))
define_tool_parameter_7 = DefineToolParameter(Name="iterations", Type="Integer / Number", Description=panel_4, Required=Toggle(True))
define_tool_parameter_8 = DefineToolParameter(Name="Anti-clockwise", Type="number", Description=panel_8, Required=Toggle(True))
define_tool_parameter_9 = DefineToolParameter(Name="seed", Type="Integer", Description=panel_6, Required=Toggle(True))
define_tool_parameter_10 = DefineToolParameter(Name="Clockwise", Type="number", Description=panel_10, Required=Toggle(True))
define_tool_parameter_11 = DefineToolParameter(Name="Right", Type="number", Description="move building on +x", Required=Toggle(True))
define_tool_parameter_12 = DefineToolParameter(Name="Up", Type="number", Description="move building on +y", Required=Toggle(True))
define_tool_parameter_13 = DefineToolParameter(Name="Down", Type="number", Description="move building on -y", Required=Toggle(True))
define_tool_parameter_14 = DefineToolParameter(Name="Left", Type="number", Description="move building on -x", Required=Toggle(True))
merge = Merge(
    Data1=define_tool_parameter_5,
    Data2=define_tool_parameter_3,
    Data3=define_tool_parameter_4,
    Data4=define_tool_parameter_6,
    Data5=define_tool_parameter_2,
    Data6=define_tool_parameter,
    Data7=define_tool_parameter_7,
    Data8=define_tool_parameter_9)
merge_2 = Merge(Data1=define_tool_parameter_10, Data2=define_tool_parameter_8)
merge_3 = Merge(
    Data1=define_tool_parameter_14,
    Data2=define_tool_parameter_11,
    Data3=define_tool_parameter_12,
    Data4=define_tool_parameter_13)
define_tool = DefineTool(Name="Rotate", Description="based on user requirement the building will rotate", Parameters=merge_2)
define_tool_2 = DefineTool(Name="parametric_shape_generator", Description=panel_11, Parameters=merge)
define_tool_3 = DefineTool(Name="move", Description="based on user requirement the building will move", Parameters=merge_3)
merge_4 = Merge(Data1=define_tool_2, Data2=define_tool_3, Data3=define_tool)
panel_12 = Panel(merge_4)
result = ClusterOutput(merge_4)
