# Grasshopper definition test.gh (Grasshopper 1.0.8)
# plug-ins: froGH, Swiftlet

define_tool_parameter = DefineToolParameter(Name="layer_name", Type="string", Required=True)
define_tool_parameter_2 = DefineToolParameter(Name="geometry_id", Type="string", Required=True)
define_tool_parameter_3 = DefineToolParameter(Name="boundary", Type="array of `[x, y, z]` points", Required=True)
define_tool_parameter_4 = DefineToolParameter(Name="shape_type", Type="string", Required=True)
define_tool_parameter_5 = DefineToolParameter(Name="closed", Type="boolean", Required=True)
define_tool_parameter_6 = DefineToolParameter(Name="site_boundary", Type="array of `[x, y, z]` points", Required=True)
define_tool_parameter_7 = DefineToolParameter(Name="site_guid", Type="string", Required=True)
define_tool_parameter_8 = DefineToolParameter(Name="building_boundary", Type="array of `[x, y, z]` points", Required=True)
define_tool_parameter_9 = DefineToolParameter(Name="site_boundary", Type="array of `[x, y, z]` points", Required=True)
panel = Panel("Read a closed site boundary polyline from Grasshopper/Rhino and return corrdinates for downstream building fit checks.")
panel_2 = Panel("Tool that test if the building boundary is inside the site without overlapping the set boundary")
panel_3 = Panel("Create Rhino/Grasshopper geometry from a Python-generated closed building boundary.")
define_tool = DefineTool(
    Name="import_building_boundary",
    Description=panel_3,
    Parameters=[define_tool_parameter_2, define_tool_parameter_3, define_tool_parameter_4, define_tool_parameter, define_tool_parameter_5])
define_tool_2 = DefineTool(Name="site_boundary_reader", Description=panel, Parameters=[define_tool_parameter_7, define_tool_parameter_6])
define_tool_3 = DefineTool(Name="test_fit", Description=panel_2, Parameters=[define_tool_parameter_9, define_tool_parameter_8])
mcp_server = MCPServer(Port=3001, Tools=[define_tool, define_tool_2, define_tool_3], ServerName="Swiftlet")  # -> Import_building_boundary, Site_boundary_reader, Test_fit
curve = Curve(<curve referenced from the Rhino model>)
deconstruct_tool_call = DeconstructToolCall(Request=mcp_server.Test_fit)  # -> Request, Tool, Arguments
crvtojson = CrvToJson(crv=curve, key="site_boundary")
jsontocrv = JsonToCrv_2(jsonobj=deconstruct_tool_call.Arguments, key="site_boundary")
jsontocrv_2 = JsonToCrv_2(jsonobj=deconstruct_tool_call.Arguments, key="building_boundary")
deconstruct_tool_call_2 = DeconstructToolCall(Request=mcp_server.Import_building_boundary)  # -> Request, Tool, Arguments
explode = Explode(Curve=jsontocrv_2, Recursive=True)  # -> Segments, Vertices
cull_index = CullIndex(List=explode.Vertices, Indices="-1", Wrap=True)
point_in_curve = PointInCurve(Point=cull_index, Curve=jsontocrv)  # -> Relationship, Point
jsontocrv_3 = JsonToCrv(jsonobj=deconstruct_tool_call_2.Arguments, key="boundary")
deconstruct_tool_call_3 = DeconstructToolCall(Request=mcp_server.Site_boundary_reader)  # -> Request, Tool, Arguments
area = Area(Geometry=curve)  # -> Area, Centroid
curve_2 = Curve(jsontocrv_3)
equality = Equality(FirstNumber=point_in_curve.Relationship, SecondNumber=2)  # -> Equality, Inequality
mass_boolean = MassBoolean(Values=equality.Equality, BooleanOperator="AND")
area_2 = Area(Geometry=curve_2)  # -> Area, Centroid
create_json_value = CreateJSONValue(Value=mass_boolean)
create_json_value_2 = CreateJSONValue(Value=area_2.Area)
panel_4 = Panel(area.Area)
create_json_object = CreateJSONObject(Keys="area", Values=create_json_value_2)
mcp_tool_response = MCPToolResponse(Request=deconstruct_tool_call_2.Request, Content=create_json_object, IsError=False)
create_json_object_2 = CreateJSONObject(Keys="IsFit", Values=create_json_value)
mcp_tool_response_2 = MCPToolResponse(Request=deconstruct_tool_call.Request, Content=create_json_object_2, IsError=False)
create_json_value_3 = CreateJSONValue(Value=area.Area)
create_json_object_3 = CreateJSONObject(Keys="area", Values=create_json_value_3)
mcp_tool_response_3 = MCPToolResponse(Request=deconstruct_tool_call_3.Request, Content=crvtojson, IsError=False)
panel_5 = Panel(area_2.Area)
panel_6 = Panel(mcp_tool_response)
panel_7 = Panel(mcp_tool_response_2)
panel_8 = Panel(mcp_tool_response_3)

# ==== cluster CrvToJson
crv = ClusterInput()
explode = Explode(Curve=crv, Recursive=True)  # -> Segments, Vertices
deconstruct = Deconstruct(Point=explode.Vertices)  # -> XComponent, YComponent, ZComponent
merge = Merge(Data1=graft(deconstruct.XComponent), Data2=graft(deconstruct.YComponent), Data3=graft(deconstruct.ZComponent))
create_json_value = CreateJSONValue(Value=merge)
create_json_array = CreateJSONArray(JTokens=create_json_value)  # -> flatten(JArray)
key = ClusterInput()
create_json_array_2 = CreateJSONArray(JTokens=create_json_array)
create_json_object = CreateJSONObject(Keys=key, Values=create_json_array_2)
json = ClusterOutput(create_json_object)

# ==== cluster JsonToCrv
key = ClusterInput()
jsonobj = ClusterInput()
get_json_object_key = GetJSONObjectKey(JObject=jsonobj, Key=key)
read_json_array = ReadJSONArray(Array=get_json_object_key)
read_json_array_2 = ReadJSONArray(Array=read_json_array)
read_json_value = ReadJSONValue(JValue=read_json_array_2)  # -> AsString, AsNumber, AsBool
list_item = ListItem(List=read_json_value.AsString, Index=0, Wrap=True)  # -> Item, Item1, Item2
construct_point = ConstructPoint(XCoordinate=list_item.Item, YCoordinate=list_item.Item1, ZCoordinate=list_item.Item2)
polyline = PolyLine(Vertices=flatten(construct_point), Closed=False)
crv = ClusterOutput(polyline)

# ==== cluster JsonToCrv_2
jsonobj = ClusterInput()
key = ClusterInput()
get_json_object_key = GetJSONObjectKey(JObject=jsonobj, Key=key)
read_json_value = ReadJSONValue(JValue=get_json_object_key)  # -> AsString, AsNumber, AsBool
deserialize_json = DeserializeJson(JSON=read_json_value.AsString, OutputsLocked=False)
deserialize_json_2 = DeserializeJson(JSON=deserialize_json, OutputsLocked=False)
list_item = ListItem(List=deserialize_json_2, Index=0, Wrap=True)  # -> Item, Item1, Item2
construct_point = ConstructPoint(XCoordinate=list_item.Item, YCoordinate=list_item.Item1, ZCoordinate=list_item.Item2)
polyline = PolyLine(Vertices=flatten(construct_point), Closed=False)
crv = ClusterOutput(polyline)
