# Grasshopper definition team_05_working-mf.gh (Grasshopper 1.0.8)
# plug-ins: Swiftlet

# ----
# Connect MCP Tools to Decall and Update All Clusters
button = Button()
# IF SOMETHING IS NOT
# WORKING PRESS THIS
# BUTTON FIRST
toggle = BooleanToggle(True)
connect_mcp_tools_to_decall = CSharpScript(nickname_From="Central MCP Server", nickname_To="Central DeCall", connect=button)  # -> out; inputs nickname_From: String, nickname_To: String, connect: Boolean
# ---------- connect_mcp_tools_to_decall: C# ----------
using System;
using System.Linq;
using Grasshopper;
using Grasshopper.Kernel;

public class Script_Instance : GH_ScriptInstance
{
    private void RunScript(string nickname_From, string nickname_To, bool connect)
    {
        if (!connect) return;
        Console.Write($"Attempting to connect outputs from '{nickname_From}' to '{nickname_To}'...");

        var ghDoc = Instances.ActiveCanvas?.Document;
        if (ghDoc == null) return;

        var compFrom = ghDoc.Objects
            .OfType<IGH_Component>()
            .FirstOrDefault(o => o.NickName == nickname_From);

        var compTo = ghDoc.Objects
            .OfType<IGH_Param>()
            .FirstOrDefault(o => o.NickName == nickname_To);

        if (compFrom != null && compTo != null)
        {
            ghDoc.ScheduleSolution(5, doc => Connect(doc, compFrom, compTo));
        }
    }

    // <Custom additional code> 
    private void Connect(GH_Document doc, IGH_Component compFrom, IGH_Param compTo)
    {
        if (compFrom == null || compTo == null) return;

        foreach (IGH_Param param in compFrom.Params.Output)
        {
            compTo.AddSource(param);
        }
    }
}
# ---------- end connect_mcp_tools_to_decall ----------
update_all_clusters = CSharpScript(update=button, recursive=toggle)  # -> out, A; inputs update: Boolean, recursive: Boolean, passwords: list of String, localPath: String
# ---------- update_all_clusters: C# ----------
using System;
using System.Collections;
using System.Collections.Generic;

using Rhino;
using Rhino.Geometry;

using Grasshopper;
using Grasshopper.Kernel;
using Grasshopper.Kernel.Data;
using Grasshopper.Kernel.Types;
using System.Windows.Forms;
using System.Linq;
/// <summary>
/// This class will be instantiated on demand by the Script component.
/// </summary>
public class Script_Instance : GH_ScriptInstance
{
  /// <summary>Print a String to the [Out] Parameter of the Script component.</summary>
  /// <param name="text">String to print.</param>
  private void Print(string text) { /* Implementation hidden. */ }
  /// <summary>Print a formatted String to the [Out] Parameter of the Script component.</summary>
  /// <param name="format">String format.</param>
  /// <param name="args">Formatting parameters.</param>
  private void Print(string format, params object[] args) { /* Implementation hidden. */ }
  /// <summary>Print useful information about an object instance to the [Out] Parameter of the Script component. </summary>
  /// <param name="obj">Object instance to parse.</param>
  private void Reflect(object obj) { /* Implementation hidden. */ }
  /// <summary>Print the signatures of all the overloads of a specific method to the [Out] Parameter of the Script component. </summary>
  /// <param name="obj">Object instance to parse.</param>
  private void Reflect(object obj, string method_name) { /* Implementation hidden. */ }

  /// <summary>Gets the current Rhino document.</summary>
  private readonly RhinoDoc RhinoDocument;
  /// <summary>Gets the Grasshopper document that owns this script.</summary>
  private readonly GH_Document GrasshopperDocument;
  /// <summary>Gets the Grasshopper script component that owns this script.</summary>
  private readonly IGH_Component Component;
  /// <summary>
  /// Gets the current iteration count. The first call to RunScript() is associated with Iteration==0.
  /// Any subsequent call within the same solution will increment the Iteration count.
  /// </summary>
  private readonly int Iteration;

  /// <summary>
  /// This procedure contains the user code. Input parameters are provided as regular arguments,
  /// Output parameters as ref arguments. You don't have to assign output parameters,
  /// they will have a default value.
  /// </summary>
  private void RunScript(
		bool update,
		bool recursive,
		List<string> passwords,
		string localPath,
		ref object A)
  {

    A = updateLog;
    if (update)
    {
      updateLog = new List<string>();
      _passwords = passwords;
      UpdateClusters(GrasshopperDocument, recursive, localPath);
    }

  }

  // <Custom additional code> 
  List<string> updateLog;
  List<String> _passwords;

  void UpdateClusters (GH_Document ghDoc, bool recursive, string localPath)
  {
    foreach (var obj in ghDoc.Objects)
    {
      var cluster = obj as Grasshopper.Kernel.Special.GH_Cluster;
      if (cluster != null)
      {
        var clusterPath = cluster.FilePath;
        if (!string.IsNullOrEmpty(clusterPath))
        {
          if (cluster.Synchronisation == Grasshopper.Kernel.Special.GH_Synchronisation.OutOfDate)
          {
            cluster.CreateFromFilePath(clusterPath);
            updateLog.Add("Updated: " + clusterPath);
          }
          else if (cluster.Synchronisation == Grasshopper.Kernel.Special.GH_Synchronisation.MissingReference)
          {
            string newPath = ReplacePath(localPath, clusterPath);
            if (!string.IsNullOrEmpty(newPath))
            {
              cluster.CreateFromFilePath(newPath);
              updateLog.Add("Replaced and updated: " + newPath);
            }
            else
            {
              updateLog.Add("Missing reference: " + clusterPath);
            }

          }
        }

        //Update recursively
        if (recursive)
        {
          GH_Document clusterDoc = GetClusterDoc(cluster);
          if (clusterDoc != null)
            UpdateClusters(clusterDoc, recursive, localPath);
        }
      }
    }
  }

  GH_Document GetClusterDoc(Grasshopper.Kernel.Special.GH_Cluster cluster)
  {
    //no pass needed
    var doc = cluster.Document(string.Empty);
    if (doc != null)
      return doc;

    //try passwords
    if (_passwords != null && _passwords.Any())
    {
      foreach (var pass in _passwords)
      {
        doc = cluster.Document(pass);
        if (doc != null)
          return doc;
      }
    }

    return null;
  }

  string ReplacePath(string localPath, string missingPath)
  {
    if (String.IsNullOrEmpty(missingPath) || string.IsNullOrEmpty(localPath))
      return null;
    else
    {
      string lastLocalPart = localPath.Split('\\').Last();
      string[] parts = missingPath.Split('\\');
      if (parts.Contains(lastLocalPart))
      {
        int i = Array.IndexOf(parts, lastLocalPart);
        string clusterPath = String.Join("\\", parts.Skip(i + 1));
        string result = String.Join("\\", localPath, clusterPath);
        return result;
      }
      else
        return null;
    }
  }
  // </Custom additional code> 
}
# ---------- end update_all_clusters ----------
panel = Panel(connect_mcp_tools_to_decall)

team_05_definition_cluster = Team05DefinitionCluster()
c_script = CSharpScript()  # -> out, availablePort
# ---------- c_script: C# ----------
// Grasshopper Script Instance
// This script finds an available port on the local machine.
#region Usings
using System;
using System.Linq;
using System.Collections;
using System.Collections.Generic;
using System.Drawing;
using System.Net;
using System.Net.Sockets;

using Rhino;
using Rhino.Geometry;

using Grasshopper;
using Grasshopper.Kernel;
using Grasshopper.Kernel.Data;
using Grasshopper.Kernel.Types;
#endregion

public class Script_Instance : GH_ScriptInstance
{
    #region Notes
    /* 
      Members:
        RhinoDoc RhinoDocument
        GH_Document GrasshopperDocument
        IGH_Component Component
        int Iteration

      Methods (Virtual & overridable):
        Print(string text)
        Print(string format, params object[] args)
        Reflect(object obj)
        Reflect(object obj, string method_name)
    */
    #endregion

    private void RunScript(object start, object end, ref object availablePort)
    {
        // Use default values if parameters are not provided
        int startPort = (start != null && int.TryParse(start.ToString(), out int s)) ? s : 3001;
        int endPort = (end != null && int.TryParse(end.ToString(), out int e)) ? e : 3100;

        // Find an available port in the specified range
        try
        {
            availablePort = FindAvailablePortInRange(startPort, endPort);
            Print($"Available port found: {availablePort}");
        }
        catch (Exception ex)
        {
            Print($"Error: {ex.Message}");
            availablePort = null;
        }
    }

    /// <summary>
    /// Checks if a local TCP port is available for binding (i.e., not in use).
    /// Returns True if available, False otherwise.
    /// </summary>
    private bool IsPortAvailableForBind(int port)
    {
        try
        {
            // Create a new TCP socket
            using (Socket socket = new Socket(AddressFamily.InterNetwork, SocketType.Stream, ProtocolType.Tcp))
            {
                // Try to bind to the port on all interfaces (0.0.0.0)
                socket.Bind(new IPEndPoint(IPAddress.Any, port));
                // If successful, the socket is closed by the using statement and return True
                return true;
            }
        }
        catch (SocketException)
        {
            // If binding fails, it means the port is already in use
            return false;
        }
    }

    /// <summary>
    /// Finds an available port by letting the OS assign one.
    /// </summary>
    private int FindAvailablePort()
    {
        Socket socket = new Socket(AddressFamily.InterNetwork, SocketType.Stream, ProtocolType.Tcp);
        socket.Bind(new IPEndPoint(IPAddress.Any, 0)); // Bind to an available port assigned by the OS
        int availablePort = ((IPEndPoint)socket.LocalEndPoint).Port; // Get the assigned port number
        socket.Close(); // Close the socket
        return availablePort;
    }

    /// <summary>
    /// Finds the first available port in a given range.
    /// </summary>
    private int FindAvailablePortInRange(int start = 3001, int end = 3100)
    {
        for (int port = start; port <= end; port++)
        {
            if (IsPortAvailableForBind(port))
                return port;
        }
        throw new Exception($"No available ports found in the range {start}-{end}.");
    }
}
# ---------- end c_script ----------
panel_2 = Panel(c_script.availablePort)
central_mcp_server = MCPServer(Port=c_script.availablePort, Tools=team_05_definition_cluster, ServerName="Swiftlet")  # -> Compute_volume_of_cube, Compute_volume_of_wall, Count_elements_by_type, Get_wall_geometry, Compute_element
get_tool_names = CSharpScript(x=team_05_definition_cluster)  # -> flatten(out)
# ---------- get_tool_names: C# ----------
// Grasshopper Script Instance
#region Usings
using System;
using System.Linq;
using System.Collections;
using System.Collections.Generic;
using System.Drawing;

using Rhino;
using Rhino.Geometry;

using Grasshopper;
using Grasshopper.Kernel;
using Grasshopper.Kernel.Data;
using Grasshopper.Kernel.Types;
#endregion

public class Script_Instance : GH_ScriptInstance
{
    #region Notes
    /* 
      Members:
        RhinoDoc RhinoDocument
        GH_Document GrasshopperDocument
        IGH_Component Component
        int Iteration

      Methods (Virtual & overridable):
        Print(string text)
        Print(string format, params object[] args)
        Reflect(object obj)
        Reflect(object obj, string method_name)
    */
    #endregion

    private void RunScript(object x)
    {
        dynamic dynamicX = x;
        Console.Write(dynamicX.Name);
    }
}
# ---------- end get_tool_names ----------
panel_3 = Panel("This tool computes the volume of a slab by giving it a length of a side.  The output unit is the input unit cubed.")
central_decall = Data([central_mcp_server.Compute_volume_of_cube, central_mcp_server.Compute_volume_of_wall, central_mcp_server.Count_elements_by_type, central_mcp_server.Get_wall_geometry, central_mcp_server.Compute_element])
clean = CleanTree(RemoveNulls=True, RemoveInvalid=True, RemoveEmpty=False, Tree=central_decall)
param = DefineToolParameter(Name="column_width", Type="number", Description="column section width in meters", Required=Toggle(True))
param_2 = DefineToolParameter(Name="column_depth", Type="number", Description="column section depth in meters", Required=Toggle(True))
param_3 = DefineToolParameter(Name="column_height", Type="number", Description="column height in meters", Required=Toggle(True))
param_4 = DefineToolParameter(Name="column_count", Type="number", Description=" number of columns", Required=Toggle(True))
param_5 = DefineToolParameter(Name="column_unit_rate", Type="number", Description="cost per m3 for column", Required=Toggle(True))
param_6 = DefineToolParameter(Name="length", Type="number", Description="The Radius of a slab", Required=Toggle(True))
param_7 = DefineToolParameter(Name="length", Type="number", Description="The Radius of a slab", Required=Toggle(True))
team_05_result_cluster = Team05ResultCluster(tool_call_request=clean)  # -> tool_names_3, tool_call_success

# ----
# Tool Names from the Results Clusters
# Tool Names from the Definition Clusters
# These Two Clusters should be EXACTLY THE SAME
panel_4 = Panel(get_tool_names)
panel_5 = Panel(team_05_result_cluster.tool_names_3)

merge = Merge(Data1=param_6, Data2=param_7)
tool = DefineTool(Name="compute_volume_of_slab", Description=panel_3, Parameters=merge)
rec = DataRecorder(team_05_result_cluster.tool_call_success, DataLimit=-10, RecordData=True)
rec_2 = DataRecorder(clean, DataLimit=-10, RecordData=True)

# ---- group: Request Parameters
decall = DeconstructToolCall(Request=clean)  # -> Request, Tool, Arguments
rjo = ReadJSONObject(JObject=decall.Arguments)  # -> Keys, JTokens
# Debug: Check request input data
panel_6 = Panel("room_name")
tmatch = MatchText(Text=rjo.Keys, Pattern=panel_6, Case=True)
tmatch_2 = MatchText(Text=rjo.Keys, Pattern="layout_json", Case=True)
dispatch = Dispatch(List=rjo.JTokens, DispatchPattern=tmatch)  # -> ListA, ListB
dispatch_2 = Dispatch(List=rjo.JTokens, DispatchPattern=tmatch_2)  # -> ListA, ListB
panel_7 = Panel(dispatch.ListA)
panel_8 = Panel(dispatch_2.ListA)

# ----
response_ok = Panel(rec)
called_tool_name = Panel(rec_2)

# ----
# Debug Tool Names
# This Panel should always be TRUE
tool_names_from_the_results_clusters = Data(panel_5)
tool_names_from_the_definition_clusters = Data(panel_4)
join = TextJoin(Text=flatten(tool_names_from_the_definition_clusters))
join_2 = TextJoin(Text=flatten(tool_names_from_the_results_clusters))
tstat = TreeStatistics(Tree=tool_names_from_the_definition_clusters)  # -> Paths, Length, Count
tstat_2 = TreeStatistics(Tree=tool_names_from_the_results_clusters)  # -> Paths, Length, Count
dpath = DeconstructPath(Branch=tstat.Paths)
dpath_2 = DeconstructPath(Branch=tstat_2.Paths)
equals = Equality(FirstNumber=tstat.Length, SecondNumber=tstat_2.Length)  # -> Equality, Inequality
equals_2 = Equality(FirstNumber=tstat.Count, SecondNumber=tstat_2.Count)  # -> Equality, Inequality
ma = MassAddition(Input=flatten(equals.Equality))  # -> Result, PartialResults
equals_3 = Equality(FirstNumber=dpath, SecondNumber=dpath_2)  # -> Equality, Inequality
lng = ListLength(List=equals.Equality)
ma_2 = MassAddition(Input=flatten(equals_3.Inequality))  # -> Result, PartialResults
equals_4 = Equality(FirstNumber=ma.Result, SecondNumber=lng)  # -> Equality, Inequality
does_quantity_of_tools_match = Panel(equals_2.Equality)
equals_5 = Equality(FirstNumber=ma_2.Result, SecondNumber="0")  # -> Equality, Inequality
does_quantity_of_tools_match_per_team = Panel(equals_4.Equality)
are_all_teams_included = Panel(equals_5.Equality)

tmatch_3 = MatchText(Text=join, Pattern=join_2, Case=True)

do_all_names_match = Panel(tmatch_3)
and = GateAnd(A=equals_5.Equality, B=equals_4.Equality, C=equals_2.Equality, D=tmatch_3)  # -> flatten(Result)
do_trees_match = Panel(and)

# ==== cluster Team05DefinitionCluster
# compute_ structurel element
panel = Panel("Computes volume and cost of a structural element (slab, wall, beam, column, footing). Returns volume and cost.")

# ----
# COUNT ELEMENTS BY TYPE
panel_2 = Panel("This tool counts how many doors and windows of a curtain type are there in a layout ")
param = DefineToolParameter(Name="door_count", Type="number", Description="how many doors are there", Required=Toggle(True))
param_2 = DefineToolParameter(Name="door_type", Type="string", Description="what type the doors is", Required=Toggle(True))
param_3 = DefineToolParameter(Name="window_count", Type="number", Description="how many windows are there", Required=Toggle(True))
param_4 = DefineToolParameter(Name="window_type", Type="string", Description="what type the window is", Required=Toggle(True))
merge = Merge(Data1=param, Data2=param_2, Data3=param_3, Data4=param_4)
tool = DefineTool(Name="count_elements_by_type", Description=panel_2, Parameters=merge)

# ----
# GET WALL GEOMETRY
panel_3 = Panel("This tools gets the wall geometry information inside the model and returns a json file")
toggle = BooleanToggle(True)
param_5 = DefineToolParameter(Name="type", Type="string", Description="The thickness of the wall", Required=Toggle(True))
param_6 = DefineToolParameter(Name="thickness", Type="number", Description="The thickness of the wall", Required=Toggle(True))
param_7 = DefineToolParameter(Name="width", Type="number", Description="the width of the wall", Required=Toggle(True))
param_8 = DefineToolParameter(Name="heigth", Type="number", Description="The heigth of the wall", Required=Toggle(True))
param_9 = DefineToolParameter(Name="length", Type="number", Description="The length of the wall", Required=Toggle(True))
merge_2 = Merge(Data1=param_7, Data2=param_9, Data3=param_8, Data4=param_6, Data5=param_5)
tool_2 = DefineTool(Name="get_wall_geometry", Description=panel_3, Parameters=merge_2)

# ----
# COMPUTE VOLUME OF A WALL
panel_4 = Panel("This tool calculates the volume of the walls")
param_10 = DefineToolParameter(Name="wall_length", Type="number", Description="the length of the wall", Required=Toggle(True))
param_11 = DefineToolParameter(Name="wall_unit_rate", Type="number", Description="the unit rate of the wall", Required=True)
param_12 = DefineToolParameter(Name="wall_width", Type="number", Description="the width of the wall", Required=Toggle(True))
param_13 = DefineToolParameter(Name="wall_type", Type="string", Description="the type of the wall", Required=Toggle(True))
param_14 = DefineToolParameter(Name="wall_heigth", Type="number", Description="the heigth of the wall", Required=Toggle(True))
merge_3 = Merge(Data1=param_10, Data2=param_12, Data3=param_14, Data4=param_13, Data5=param_11)
tool_3 = DefineTool(Name="compute_volume_of_wall", Description=panel_4, Parameters=merge_3)

# ----
# Team 05 Definition Cluster
# CUBE TEAM
panel_5 = Panel("This tool computes the volume of a cube by giving it a length of a side.  The output unit is the input unit cubed.")
param_15 = DefineToolParameter(Name="count", Type="number", Description="number of identical elements (default 1)", Required=True)
param_16 = DefineToolParameter(
    Name="element_type",
    Type="string",
    Description="type of element: slab, wall, beam, column, footing",
    Required=Toggle(True))
param_17 = DefineToolParameter(Name="unit_rate", Type="number", Description="cost per unit volume", Required=True)
param_18 = DefineToolParameter(Name="length", Type="number", Description="length of the element", Required=Toggle(True))
param_19 = DefineToolParameter(Name="height", Type="number", Description="height or thickness of the element", Required=Toggle(True))
param_20 = DefineToolParameter(Name="width", Type="number", Description="width of the element", Required=Toggle(True))
param_21 = DefineToolParameter(Name="length", Type="number", Description="The Radius of a Cube", Required=Toggle(True))
merge_4 = Merge(Data1=param_16, Data2=param_18, Data3=param_20, Data4=param_19, Data5=param_17)
merge_5 = Merge(Data1=param_21)
tool_4 = DefineTool(Name="compute_element", Description=panel, Parameters=merge_4)
tool_5 = DefineTool(Name="compute_volume_of_cube", Description=panel_5, Parameters=merge_5)
merge_6 = Merge(Data1=tool_5, Data2=tool_3, Data3=tool_2, Data4=tool, Data5=tool_4)
R = ClusterOutput(merge_6)

# ==== cluster Team05ResultCluster

# ----
# Team 05 Result Cluster
# CUBE TEAM
# Edit Tool Names to
# Match Definition Cluster
tool_names = Panel("""compute_volume_of_cube
compute_volume_of_wall
get_wall_geometry
count_elements_by_type
compute_element""")

# ----
# Sorting Logic, Please Do Not Edit
tool_call_request = ClusterInput()
tool_names_2 = Text(tool_names)
decall = DeconstructToolCall(Request=tool_call_request)  # -> Request, Tool, Arguments
mindex = MemberIndex(Set=tool_names, Member=decall.Tool)  # -> Index, Count
sift = SiftPattern(List=decall.Request, SiftPattern=mindex.Index)  # -> Output0, Output1, Output2, Output3, Output4

# ---- group: Cluster Output
tool_names_3 = ClusterOutput(tool_names_2)

# ----
# COMPUTE_VOLUME_OF_CUBE
decall_2 = DeconstructToolCall(Request=sift.Output0)  # -> Request, Tool, Arguments
gjok = GetJSONObjectKey(JObject=decall_2.Arguments, Key="length")
rjv = ReadJSONValue(JValue=gjok)  # -> AsString, AsNumber, AsBool
rectangle = Rectangle(Plane=PlaneXY(0, 0, 0), XSize=rjv.AsNumber, YSize=rjv.AsNumber, Radius=0)  # -> Rectangle, Length
boxrec = BoxRectangle(Rectangle=rectangle.Rectangle, Height=rjv.AsNumber)
volume = Volume(Geometry=boxrec)  # -> Volume, Centroid
panel = Panel(volume.Volume)
cjv = CreateJSONValue(Value=panel)
cjo = CreateJSONObject(Keys="volume", Values=cjv)
respond = MCPToolResponse(Request=decall_2.Request, Content=cjo, IsError=False)

# ----
# COMPUTE_VOLUME_OF_WALL
decall_3 = DeconstructToolCall(Request=sift.Output1)  # -> Request, Tool, Arguments
gjok_2 = GetJSONObjectKey(JObject=decall_3.Arguments, Key="wall_type")
gjok_3 = GetJSONObjectKey(JObject=decall_3.Arguments, Key="wall_unit_rate")
gjok_4 = GetJSONObjectKey(JObject=decall_3.Arguments, Key="wall_width")
gjok_5 = GetJSONObjectKey(JObject=decall_3.Arguments, Key="wall_heigth")
gjok_6 = GetJSONObjectKey(JObject=decall_3.Arguments, Key="wall_length")
rjv_2 = ReadJSONValue(JValue=gjok_2)  # -> AsString, AsNumber, AsBool
rjv_3 = ReadJSONValue(JValue=gjok_3)  # -> AsString, AsNumber, AsBool
read_json_value = ReadJSONValue(JValue=gjok_6)  # -> AsString, AsNumber, AsBool
rjv_4 = ReadJSONValue(JValue=gjok_4)  # -> AsString, AsNumber, AsBool
rjv_5 = ReadJSONValue(JValue=gjok_5)  # -> AsString, AsNumber, AsBool
multiplication = Multiplication(A=read_json_value.AsNumber, B=rjv_5.AsNumber, C=rjv_4.AsNumber)
multiplication_2 = Multiplication(A=multiplication, B=rjv_3.AsNumber)
merge = Merge(Data1=multiplication, Data2=rjv_2.AsString, Data3=multiplication_2)
respond_2 = MCPToolResponse(Request=decall_3.Request, Content=merge, IsError=False)

# ---- group: Get the request sent from VSC Agent
decall_4 = DeconstructToolCall(Request=sift.Output3)  # -> Request, Tool, Arguments

# ----
# COUNT_ELEMENTS_BY_TYPE
panel_2 = Panel("window_type")
gjok_7 = GetJSONObjectKey(JObject=decall_4.Arguments, Key="door_count")
gjok_8 = GetJSONObjectKey(JObject=decall_4.Arguments, Key="door_type")
gjok_9 = GetJSONObjectKey(JObject=decall_4.Arguments, Key="window_count")
gjok_10 = GetJSONObjectKey(JObject=decall_4.Arguments, Key=panel_2)
rjv_6 = ReadJSONValue(JValue=gjok_9)  # -> AsString, AsNumber, AsBool
rjv_7 = ReadJSONValue(JValue=gjok_10)  # -> AsString, AsNumber, AsBool
rjv_8 = ReadJSONValue(JValue=gjok_7)  # -> AsString, AsNumber, AsBool
rjv_9 = ReadJSONValue(JValue=gjok_8)  # -> AsString, AsNumber, AsBool
list_length = ListLength(List=rjv_8.AsNumber)
list_length_2 = ListLength(List=rjv_6.AsNumber)
panel_3 = Panel(list_length)
panel_4 = Panel(rjv_9.AsString)
panel_5 = Panel(list_length_2)
panel_6 = Panel(rjv_7.AsString)
cjv_2 = CreateJSONValue(Value=panel_3)
cjv_3 = CreateJSONValue(Value=panel_4)
cjv_4 = CreateJSONValue(Value=panel_5)
cjv_5 = CreateJSONValue(Value=panel_6)
cjo_2 = CreateJSONObject(Keys="door_count", Values=cjv_2)
cjo_3 = CreateJSONObject(Keys="door_type", Values=cjv_3)
cjo_4 = CreateJSONObject(Keys="window_count", Values=cjv_4)
cjo_5 = CreateJSONObject(Keys="window_type", Values=cjv_5)
merge_2 = Merge(Data1=cjo_2, Data2=cjo_3, Data3=cjo_4, Data4=cjo_5)
respond_3 = MCPToolResponse(Request=decall_4.Request, Content=merge_2, IsError=False)

merge_3 = Merge(Data1="volume", Data2="type", Data3="cost")

# ----
# GET_WALL_GEOMETRY
decall_5 = DeconstructToolCall(Request=sift.Output2)  # -> Request, Tool, Arguments
gjok_11 = GetJSONObjectKey(JObject=decall_5.Arguments, Key="type")
gjok_12 = GetJSONObjectKey(JObject=decall_5.Arguments, Key="heigth")
gjok_13 = GetJSONObjectKey(JObject=decall_5.Arguments, Key="thickness")
gjok_14 = GetJSONObjectKey(JObject=decall_5.Arguments, Key="length")
gjok_15 = GetJSONObjectKey(JObject=decall_5.Arguments, Key="width")
rjv_10 = ReadJSONValue(JValue=gjok_11)  # -> AsString, AsNumber, AsBool
read_json_value_2 = ReadJSONValue(JValue=gjok_15)  # -> AsString, AsNumber, AsBool
rjv_11 = ReadJSONValue(JValue=gjok_12)  # -> AsString, AsNumber, AsBool
rjv_12 = ReadJSONValue(JValue=gjok_13)  # -> AsString, AsNumber, AsBool
rjv_13 = ReadJSONValue(JValue=gjok_14)  # -> AsString, AsNumber, AsBool
multiplication_3 = Multiplication(A=read_json_value_2.AsNumber, B=rjv_13.AsNumber, C=rjv_11.AsNumber, D=rjv_12.AsNumber)

panel_7 = Panel(rjv_10.AsString)
read_file = ReadFile(File="C:\Users\merof\OneDrive\Desktop\aia-studio\AIA26_Studio\team_05\gh\windows_cost.csv", PerLineParse=True)
text_split = TextSplit(Text=read_file, Separators=",")
list_item = ListItem(List=text_split, Index="0", Wrap=True)
list_item_2 = ListItem(List=text_split, Index="1", Wrap=True)
member_index = MemberIndex(Set=list_item, Member=panel_7)  # -> Index, Count
list_item_3 = ListItem(List=list_item_2, Index=member_index.Index, Wrap=True)
cost_of_one_door = Panel(list_item_3)

multiplication_4 = Multiplication(A=multiplication_3, B=list_item_3)
respond_4 = MCPToolResponse(Request=decall_5.Request, Content=multiplication_4, IsError=False)

# ----
# COMPUTE_VOLUME_OF_WALL
decall_6 = DeconstructToolCall(Request=sift.Output4)  # -> Request, Tool, Arguments
gjok_16 = GetJSONObjectKey(JObject=decall_6.Arguments, Key="element_type")
gjok_17 = GetJSONObjectKey(JObject=decall_6.Arguments, Key="unit_rate")
gjok_18 = GetJSONObjectKey(JObject=decall_6.Arguments, Key="height")
gjok_19 = GetJSONObjectKey(JObject=decall_6.Arguments, Key="width")
gjok_20 = GetJSONObjectKey(JObject=decall_6.Arguments, Key="length")
rjv_14 = ReadJSONValue(JValue=gjok_16)  # -> AsString, AsNumber, AsBool
rjv_15 = ReadJSONValue(JValue=gjok_17)  # -> AsString, AsNumber, AsBool
read_json_value_3 = ReadJSONValue(JValue=gjok_20)  # -> AsString, AsNumber, AsBool
rjv_16 = ReadJSONValue(JValue=gjok_18)  # -> AsString, AsNumber, AsBool
rjv_17 = ReadJSONValue(JValue=gjok_19)  # -> AsString, AsNumber, AsBool
multiplication_5 = Multiplication(A=read_json_value_3.AsNumber, B=rjv_17.AsNumber, C=rjv_16.AsNumber)

gjok_21 = GetJSONObjectKey(JObject=decall_6.Arguments, Key="count")
rjv_18 = ReadJSONValue(JValue=gjok_21)  # -> AsString, AsNumber, AsBool
rectangle_2 = Rectangle(Plane=PlaneXY(0, 0, 0), XSize=read_json_value_3.AsNumber, YSize=rjv_17.AsNumber, Radius=0)  # -> Rectangle, Length
boxrec_2 = BoxRectangle(Rectangle=rectangle_2.Rectangle, Height=rjv_16.AsNumber)
brep = Brep(boxrec_2)

multiplication_6 = Multiplication(A=multiplication_5, B=rjv_15.AsNumber, C=rjv_18.AsNumber)
merge_4 = Merge(Data1=multiplication_5, Data2=rjv_14.AsString, Data3=multiplication_6)

cjv_6 = CreateJSONValue(Value=merge_4)
cjo_6 = CreateJSONObject(Keys=merge_3, Values=cjv_6)

respond_5 = MCPToolResponse(Request=decall_6.Request, Content=cjo_6, IsError=False)

or = GateOr(A=respond, B=respond_2, C=respond_4, D=respond_3, E=respond_5)
tool_call_success = ClusterOutput(or)
