# Grasshopper definition DaylightAnalysis.gh (Grasshopper 1.0.8)
# plug-ins: Pufferfish, LadybugGrasshopper

panel = Panel("""{
    "layoutId": "layout-1",
    "apartment": {
      "id": "layout-1",
      "name": "Sample A",
      "geometry": [
        [
          -3.088417104695468,
          -2.628440089102522
        ],
        [
          -3.088417104695468,
          2.628440089102522
        ],
        [
          3.088417104695468,
          2.628440089102522
        ],
        [
          3.088417104695468,
          -2.628440089102522
        ],
        [
          -3.088417104695468,
          -2.628440089102522
        ]
      ],
      "attributes": {
        "area": 32.47
      }
    },
    "outline": [
      [
        -3.088417104695468,
        -2.628440089102522
      ],
      [
        -3.088417104695468,
        2.628440089102522
      ],
      [
        3.088417104695468,
        2.628440089102522
      ],
      [
        3.088417104695468,
        -2.628440089102522
      ],
      [
        -3.088417104695468,
        -2.628440089102522
      ]
    ],
    "rooms": [
      {
        "id": "room-1",
        "name": "Bedroom",
        
        "geometry": [
          [
            0.22102791658357113,
            -2.628440089102522
          ],
          [
            3.088417104695468,
            -2.628440089102522
          ],
          [
            3.088417104695468,
            0.3106338287121311
          ],
          [
            0.22102791658357113,
            0.3106338287121311
          ],
          [
            0.22102791658357113,
            -2.628440089102522
          ]
        ],
        "attributes": {
          "area": 8.43,
          "program": "bedroom"
        }
      },
      {
        "id": "room-2",
        "name": "Living",
        "geometry": [
          [
            -3.088417104695468,
            -2.628440089102522
          ],
          [
            0.22102791658357113,
            -2.628440089102522
          ],
          [
            0.22102791658357113,
            0.3106338287121311
          ],
          [
            -3.088417104695468,
            0.3106338287121311
          ],
          [
            -3.088417104695468,
            -2.628440089102522
          ]
        ],
        "attributes": {
          "area": 9.73,
          "program": "living"
        }
      },
      {
        "id": "room-3",
        "name": "Kitchen",
        "geometry": [
          [
            -3.088417104695468,
            0.3106338287121311
          ],
          [
            0.22102791658357113,
            0.3106338287121311
          ],
          [
            0.22102791658357113,
            2.628440089102522
          ],
          [
            -3.088417104695468,
            2.628440089102522
          ],
          [
            -3.088417104695468,
            0.3106338287121311
          ]
        ],
        "attributes": {
          "area": 7.67,
          "program": "kitchen"
        }
      },
      {
        "id": "room-4",
        "name": "Bathroom",
        "geometry": [
          [
            0.22102791658357113,
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""")
panel_2 = Panel("""{
    "layoutId": "layout-4",
    "apartment": {
      "id": "layout-4",
      "name": "Sample D",
      "geometry": [
        [
          -2.672592933816336,
          -3.29130776574992
        ],
        [
          -2.672592933816336,
          3.29130776574992
        ],
        [
          2.672592933816336,
          3.29130776574992
        ],
        [
          2.672592933816336,
          -3.29130776574992
        ],
        [
          -2.672592933816336,
          -3.29130776574992
        ]
      ],
      "attributes": {
        "area": 35.19
      }
    },
    "outline": [
      [
        -2.672592933816336,
        -3.29130776574992
      ],
      [
        -2.672592933816336,
        3.29130776574992
      ],
      [
        2.672592933816336,
        3.29130776574992
      ],
      [
        2.672592933816336,
        -3.29130776574992
      ],
      [
        -2.672592933816336,
        -3.29130776574992
      ]
    ],
    "rooms": [
      {
        "id": "room-1",
        "name": "Bathroom",
        "geometry": [
          [
            0.8874443141368253,
            1.7096063312608152
          ],
          [
            2.672592933816336,
            1.7096063312608152
          ],
          [
            2.672592933816336,
            3.29130776574992
          ],
          [
            0.8874443141368253,
            3.29130776574992
          ],
          [
            0.8874443141368253,
            1.7096063312608152
          ]
        ],
        "attributes": {
          "area": 2.82,
          "program": "bathroom"
        }
      },
      {
        "id": "room-2",
        "name": "Foyer",
        "geometry": [
          [
            0.8874443141368253,
            1.2394468440254798
          ],
          [
            1.7391485831964353,
            1.2394468440254798
          ],
          [
            1.7391485831964353,
            1.7096063312608152
          ],
          [
            0.8874443141368253,
            1.7096063312608152
          ],
          [
            0.8874443141368253,
            1.2394468440254798
          ]
        ],
        "attributes": {
          "area": 0.4,
          "program": "foyer"
        }
      },
      {
        "id": "room-3",
        "name": "Extra",
        "geometry": [
          [
            1.7391485831964353,
            1.2394468440254798
          ],
          [
            2.672592933816336,
            1.2394468440254798
          ],
          [
            2.672592933816336,
            1.7096063312608152
          ],
          [
            1.7391485831964353,
            1.7096063312608152
          ],
          [
            1.7391485831964353,
            1.2394468440254798
          ]
        ],
        "attributes": {
          "area": 0.44,
          "program": "extra"
        }
      },
      {
        "id": "room-4",
        "name": "Bedroom",
        "geometry": [
          [
            -2.672592933816336,
            -3.29130776574992
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""")
python_3_script = Python3Script(json_str=panel_2)  # -> out, room_names, room_curves, door_names, door_curves, window_names, window_curves, furniture_names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
# ---------- python_3_script: Python ----------
import json
import Rhino.Geometry as rg

def load_json_from_string(json_string):
    try:
        data = json.loads(json_string)
    except Exception as e:
        raise ValueError(f"Invalid JSON string: {e}")
    return data

def create_polyline(points, close=True):
    """Create a Rhino PolylineCurve from 2D points"""
    pts = [rg.Point3d(x, y, 0) for x, y in points]

    if close and pts[0] != pts[-1]:
        pts.append(pts[0])

    return rg.Polyline(pts).ToPolylineCurve()

def create_line(points):
    """Create a Rhino LineCurve from 2 points"""
    if len(points) != 2:
        return None
    p1 = rg.Point3d(points[0][0], points[0][1], 0)
    p2 = rg.Point3d(points[1][0], points[1][1], 0)
    return rg.LineCurve(p1, p2)

# Load JSON
layout = load_json_from_string(json_str)

# ------------------------
# FACADE (polylines)
# ------------------------
facade_curves = []
for facade in layout.get("facades", []):
    geometry = facade.get("geometry")
    if geometry:
        curve = create_polyline(geometry, close=False)
        facade_curves.append(curve)

# ------------------------
# CIRCULATION (polylines)
# ------------------------
circulation_curves = []
for circulation in layout.get("circulation", []):
    geometry = circulation.get("geometry")
    if geometry:
        curve = create_polyline(geometry, close=True)
        circulation_curves.append(curve)

# ------------------------
# ROOMS (polygons)
# ------------------------
room_names = []
room_curves = []

for room in layout.get("rooms", []):
    name = room.get("name")
    geometry = room.get("geometry")

    if name and geometry:
        curve = create_polyline(geometry, close=True)
        room_names.append(name)
        room_curves.append(curve)

# ------------------------
# DOORS (lines)
# ------------------------
door_names = []
door_curves = []

for door in layout.get("doors", []):
    name = door.get("name")
    geometry = door.get("geometry")

    if name and geometry:
        curve = create_line(geometry)
        if curve:
            door_names.append(name)
            door_curves.append(curve)

# ------------------------
# WINDOWS (lines)
# ------------------------
window_names = []
window_curves = []

for window in layout.get("windows", []):
    name = window.get("name")
    geometry = window.get("geometry")

    if name and geometry:
        curve = create_line(geometry)
        if curve:
            window_names.append(name)
            window_curves.append(curve)

# ------------------------
# FURNITURE (polygons)
# ------------------------
furniture_names = []
furniture_curves = []

for furn in layout.get("furniture", []):
    name = furn.get("name")
    geometry = furn.get("geometry")

    if name and geometry:
        curve = create_polyline(geometry, close=True)
        furniture_names.append(name)
        furniture_curves.append(curve)

# ------------------------
# OUTLINE (optional)
# ------------------------
outline_curve = None
if "outline" in layout:
    outline_curve = create_polyline(layout["outline"], close=True)

# ------------------------
# OUTPUTS
# ------------------------
room_names = room_names
room_curves = room_curves

door_names = door_names
door_curves = door_curves

window_names = window_names
window_curves = window_curves

furniture_names = furniture_names
furniture_curves = furniture_curves

outline_curve = outline_curve
facade_curves = facade_curves
circulation_curves = circulation_curves
# ---------- end python_3_script ----------
panel_3 = Panel(python_3_script.room_curves)
geometry = Geometry(python_3_script.facade_curves)
deconstruct_brep = DeconstructBrep(Brep=python_3_script.room_curves)  # -> Faces, Edges, Vertices
explode = Explode(Curve=geometry, Recursive=True)  # -> Segments, Vertices
curve_middle = CurveMiddle(Curve=deconstruct_brep.Edges)  # -> flatten(Midpoint)
pull_point = PullPoint(Point=curve_middle, Geometry=explode.Segments, ClosestOnly=True)  # -> ClosestPoint, Distance, Index
smaller_than = SmallerThan(FirstNumber=pull_point.Distance, SecondNumber="0.001")  # -> SmallerThan, OrEqualTo
cull_pattern = CullPattern(List=flatten(deconstruct_brep.Edges), CullPattern=smaller_than.SmallerThan)
floor_height = Panel("3")
unit_z = UnitZ(Factor=floor_height)
extrude = Extrude(Base=cull_pattern, Direction=unit_z)
floor_height_2 = Panel("3")
wwr = Slider(0.5, range=0.1..0.9)
floor_surface = Geometry(python_3_script.room_curves)
area = Area(Geometry=extrude)  # -> Area, Centroid
Z = UnitZ(Factor=floor_height_2)
extr = Extrude(Base=floor_surface, Direction=Z)
scale = Scale(Geometry=extrude, Center=area.Centroid, Factor=wwr)  # -> Geometry, Transform
cap_holes = CapHoles(Brep=extr)

# ---- group: Opaque Faces
# OPAQUE FACES
panel_4 = Panel("TestRoom")
opaque_faces = Geometry(cap_holes)
roomsolid = HBRoomFromSolid(geo=flatten(opaque_faces), name=panel_4, conditioned=True)  # -> report, rooms; plug-in component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

# ---- group: Apertures
# APERTURES
panel_5 = Panel("g_material")
windows_openings = Mesh(scale.Geometry)
glassmod = HBGlassModifier(name=panel_5, trans="0.55")  # -> modifier; plug-in component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
aperture = HBAperture(geo=windows_openings, rad_mod=glassmod)  # -> report, apertures; plug-in component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
addsubface = HBAddSubface(hb_obj=flatten(roomsolid.rooms), sub_faces=flatten(aperture.apertures))  # -> report, hb_obj, unmatched; plug-in component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

# ----
# MODEL & GRIDS
panel_6 = Panel("sample_model_grid")
model = HBModel(rooms=flatten(addsubface.hb_obj), name=panel_6)  # -> report, model; plug-in component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
gridrooms = HBSensorGridFromRooms(rooms=addsubface.hb_obj, grid_size="0.5", dist_floor="0.5", quad_only=Toggle(True))  # -> grid, points, mesh; plug-in component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
vizwiref = HBVisualizeWireframe(hb_objs=flatten(model.model))  # -> geo; plug-in component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
assigngridsviews = HBAssignGridsAndViews(model=model.model, grids=flatten(gridrooms.grid))  # -> model; plug-in component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

vizbytype = HBVisualizeByType(hb_objs=model.model)  # -> walls, interior_walls, roofs, ceilings, exterior_floors, interior_floors, air_walls, apertures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; plug-in component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
preview = CustomPreview(Geometry=vizwiref, Material=ColourSwatch(SwatchColor=RGB(0, 0, 0)))

geometry_2 = Geometry(vizbytype.walls)

# ----
# Daylight Factor(DF) - Indoors:
# Calculated as
# 
#  (Indoor illuminance/Outdoor illuminance)×100%, under an overcast sky.
# 
# 
# Sky View Factor (SVF) - Outdoors:
# Calculated as the ratio of visible sky area from a point to the entire sky hemisphere, ranging from 0 (no sky visible) to 1 (full sky view).
# DAYLIGHT
# Geometry Preparation
falsestart = LBFalseStartToggle(True)

# ----
# RUN RECIPE
daylightfactor = HBDaylightFactor(model=assigngridsviews, run=falsestart)  # -> report, results; plug-in component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

tag = TextTag(Location=gridrooms.points, Text=daylightfactor.results)
avr = Average(Input=daylightfactor.results)
bnd = Bounds(Numbers=daylightfactor.results)
roundd = RoundToDecimalPlace(NumberX=avr, DecimalPlace="1", RoundType=0)  # -> Rounded, Difference

# ----
# Visualize Results
number_slider = Slider(11, range=0..100)
legendpar = LBLegendParameters(min="0", max="15", seg_count=number_slider)  # -> leg_par; plug-in component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
data = Data(flatten(daylightfactor.results))
mjoin = MeshJoin(Meshes=gridrooms.mesh)
heatmap = LBSpatialHeatmap(values=data, mesh=mjoin, legend_par=legendpar, legend_title="%")  # -> mesh, legend, title, colors, legend_par, vis_set; plug-in component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
mesh = Mesh(heatmap.mesh)
data_2 = Data(heatmap.legend)

average_daylight_factor = Panel(bnd)
average_daylight_factor_2 = Panel(roundd.Rounded)
